vi "Check Packet.gvi"   [LabVIEW NXG 5.0.0]
inputs:
  "Message Bits": i32
  "Packet Expected": i32
outputs:
  "Cluster out": T1
types:
  T1 = cluster{"Packet Array": i32[][], "Packet Received?": bool[]}
diagram:
  Initialize Array(element=0, size=$"Packet Expected", size=$"Message Bits") -> w1
  Initialize Array(element=FALSE, size=$"Packet Expected") -> w2
  Property Node(instance in=T1 {all zero or empty}, "Packet Array"=w1, "Packet Received?"=w2) -> (instance out=w3)
  $"Cluster out" <- w3
