vi "Chop_Shell.gvi"   [LabVIEW NXG 5.1.0]
inputs:
  "data": cluster{"t0": f64, "dt": f64, "Y": c128[]}
  "Enable": bool = TRUE
outputs:
  "SIGNAL OUT": c128[]
  "Output Packets": cluster{"Packets": c128[][], "Enable?": bool}
  "RSSI": f64
  "SNR": f64
diagram:
  case ($Enable) {
    frame False, Default {
      w1 = $Enable
      w2 = default
      w3 = default
      w4 = default
      w5 = default
    }
    frame True {
      Property Node(instance in=$data) -> ("Y"=w6)
      call "DC_Offset.gvi"(Input signal samples=w6) -> (Output signal samples=w5)
      call "RSSI(-dBm), SNR(dB).gvi"(Use MathScript?=FALSE, Input Complex Samples=w5, Bin Size=100) -> (Energy Threshold=w7, noise_estimation_error ?=w8, 배열타입 RSSI=w3, 배열타입 SNR=w4)
      call "Cutting_Packet.gvi"(bin_size=16, Input Complex Samples=w5, Energy Threshold=w7) -> (packet_arr=w2, Packet Detection Error?=w9)
      Logical Or[output inverted](w9, w8) -> w1
    }
  }
  $"SIGNAL OUT" <- w5
  w10 = cluster{"Packets": c128[][], "Enable?": bool} {"Packets"=[], "Enable?"=TRUE}
  Property Node(instance in=w10, "Packets"=w2, "Enable?"=w1) -> (instance out=w11)
  $"Output Packets" <- w11
  $RSSI <- w3
  $SNR <- w4
