vi "Cutting_Packet.gvi"   [LabVIEW NXG 5.0.0]
inputs:
  "Input Complex Samples": c128[]
  "Energy Threshold": f64 = 1e-05
  "bin_size": i32 = 16
outputs:
  "packet_arr": c128[][]
  "Packet Detection Error?": bool
panel indicators:
  "Averaged Power Signal": f64[]
  "Thresholded Signal": bool[]
diagram:
  call "Power With Thresholding.gvi"(Input Complex Samples=$"Input Complex Samples", bin_size=$bin_size, threshold=$"Energy Threshold") -> (Averaged Power Signal=w1, Thresholded Signal=w2)
  $"Averaged Power Signal" <- w1
  $"Thresholded Signal" <- w2
  call "Packet_Boundaries.gvi"(Thresholded Signal=w2) -> (Packet Detection Error?=w3, packet_start_loc=w4, packet_end_loc=w5)
  Not(x=w3) -> w6
  call "Extract_Packets.gvi"(Enable?=w6, packet_start_loc=w4, packet_end_loc=w5, Input Complex Samples=$"Input Complex Samples") -> (packet_arr=w7)
  $packet_arr <- w7
  $"Packet Detection Error?" <- w3
