vi "DC_Offset.gvi"   [LabVIEW NXG 5.1.0]
inputs:
  "Input signal samples": c128[]
outputs:
  "Output signal samples": c128[]
uses:
  NI::Analysis::Windows::Hanning Window (DBL).gvi
  NI::Analysis::Statistics::Mean (DBL).gvi
diagram:
  Complex To Real And Imaginary(x + iy=$"Input signal samples") -> (x=w1, y=w2)
  call "Hanning Window (DBL).gvi"(x=w1) -> (윈도우된 x=w3)
  call "Mean (DBL).gvi"(x=w3) -> (평균=w4, 에러 출력=w5)
  Divide(x=w4, y=0.5) -> w6
  Subtract(x=w1, y=w6) -> w7
  call "Hanning Window (DBL).gvi"(x=w2) -> (윈도우된 x=w8)
  call "Mean (DBL).gvi"(x=w8) -> (평균=w9)
  Divide(x=w9, y=0.5) -> w10
  Subtract(x=w2, y=w10) -> w11
  Real And Imaginary To Complex(x=w7, y=w11) -> w12
  $"Output signal samples" <- w12
  Property Node(instance in=w5)
