vi "Extract_Packets.gvi"   [LabVIEW NXG 5.0.0]
inputs:
  "packet_start_loc": i32[]
  "packet_end_loc": i32[]
  "Input Complex Samples": c128[]
  "Enable?": bool
outputs:
  "packet_arr": c128[][]
diagram:
  case ($"Enable?") {
    frame False, Default {
      w1 = default
    }
    frame True {
      Array Size(array=$packet_start_loc) -> (size(s)=w2)
      Subtract(x=$packet_end_loc, y=$packet_start_loc) -> w3
      Increment(x=w3) -> w4
      for (N = w2) {
        w5 = each element of $packet_start_loc
        w6 = each element of w4
        Array Subset(array=$"Input Complex Samples", index0=w5, length0=w6) -> w7
        append w7 to w1
      }
    }
  }
  $packet_arr <- w1
