vi "FilterCPLX.gvi"   [LabVIEW NXG 5.0.0]
inputs:
  "filter length (symbols)": i32
  "waveform to truncate": cluster{"t0": f64, "dt": f64, "Y": c128[]}
  "samples per symbol (16)": i32
outputs:
  "truncated waveform": cluster{"t0": f64, "dt": f64, "Y": c128[]}
diagram:
  Quotient And Remainder(x=$"filter length (symbols)", y=2) -> (floor(x/y)=w1)
  Multiply($"samples per symbol (16)", w1) -> w2
  s1 = $"waveform to truncate"  # shift register
  while {
    Property Node(instance in=s1) -> ("Y"=w3, instance out=w4)
    Delete From Array(inArray=w3, length (1)=w2, index0=0) -> w5
    Property Node(instance in=w4, "Y"=w5) -> (instance out=w6)
    next s1 = w6
    stop if TRUE
  }
  $"truncated waveform" <- s1
