vi "Format_Data.gvi"   [LabVIEW NXG 5.1.0]
inputs:
  "Output Packet Array": i32[][]
outputs:
  "Received Message": string
diagram:
  Array Size(array=$"Output Packet Array") -> (size(s)=w1)  # 배열 크기
  Multiply Array Elements(numeric array=w1) -> (product=w2)
  Reshape Array(inArray=$"Output Packet Array", size=w2) -> w3
  Is Not Equal To 0(x=w3) -> w4
  w5 = 8  # Bits/Byte
  Array Size(array=w4) -> (size(s)=w6)  # 배열 크기
  Quotient And Remainder(x=w6, y=w5) -> (floor(x/y)=w7)
  Reshape Array(inArray=w4, size=w7, size=w5) -> w8
  for {
    w9 = each element of w8
    Boolean Array To Number[SignExtensionMode=1](Boolean array=w9) -> (number=w11)
    append w11 to w10
  }
  To Unsigned 8 Bit Integer(number=w10) -> w12
  Byte Array To String(encoding="Extended ASCII", unsigned byte array=w12) -> (string=w13)
  $"Received Message" <- w13
