vi "QAM Demodulation.gvi"   [LabVIEW NXG 5.1.0]
inputs:
  "Input Packets": cluster{"Packets": c128[][], "Enable?": bool}
  "QAM Init Parameters": T3
  "Rx dt": f64
outputs:
  "Output Bitstream": cluster{"bit stream": i8[][], "Enable?": bool}
  "recovered complex waveform": cluster{"t0": f64, "dt": f64, "Y": c128[]}
panel controls:
  "error in (no error)": error
panel indicators:
  "error out": error
types:
  T1 = cluster{"samples per symbol (16)": i32, "symbol map": c128[]}
  T2 = cluster{"expected sync location (symbols)": i32, "sync sequence": c128[], "sync location uncertainty (symbols)": i32, "sync indent (symbols)": i32}
  T3 = cluster{"QAM system parameters": T1, "pulse shaping filter coefficients": f64[], "matched filter coefficients": f64[], "synchronization parameters": T2, "Sync Bits": i8[]}
  T4 = cluster{"taps per symbol": i32, "delta (training)": f64, "delta (steady state)": f64}
uses:
  NI::Modulation::MT Demodulate QAM.gvi
diagram:
  Property Node(instance in=$"Input Packets") -> ("Enable?"=w1, "Packets"=w2)
  w3 = $"error in (no error)"
  case (w3) {
    frame No Error {
      Property Node(instance in=$"QAM Init Parameters") -> ("QAM system parameters"=w7, "matched filter coefficients"=w8, "synchronization parameters"=w9)
      case (w1) {
        frame False, Default {
          w4 = w3
          w10 = i8[][] []
          w11 = cluster{"t0": f64, "dt": f64, "Y": c128[]}[] []
          w12 = FALSE
        }
        frame True {
          w13 = cluster{"t0": f64, "dt": f64, "Y": c128[]} {"t0"=0, "dt"=1, "Y"=[]}
          for {
            w14 = each element of w2
            Property Node(instance in=w13, "Y"=w14, "dt"=$"Rx dt") -> (instance out=w15)
            call "MT Demodulate QAM.gvi"(reset?=TRUE, input complex waveform=w15, QAM system parameters=w7, matched filter coefficients=w8, synchronization parameters=w9, error in=w3) -> (recovered complex waveform=w16, output bit stream=w17, sync found index=w18, error out=w19)
            Is Greater Than 0(x=w18) -> w12
            w20 = T4 {"taps per symbol"=8, "delta (training)"=0.01, "delta (steady state)"=0.01}
            call "SUB_LMS-based equalizer.gvi"(LMS parameters=w20, Input signal [cluster]=w16, M-QAM system parameters=w7, User length=8, training [re-use]=w17, Error ?=w19) -> (Output signal [cluster]=w21, Error cluster=w4)
            append w17 to w10
            append w21 to w11
          }
        }
      }
      w22 = cluster{"bit stream": i8[][], "Enable?": bool} {"bit stream"=[], "Enable?"=TRUE}
      Property Node(instance in=w22, "bit stream"=w10, "Enable?"=w12) -> (instance out=w5)
      Array Index(array=w11) -> (out0[1]=w6)
    }
    frame Error {
      w23 = cluster{"bit stream": i8[][], "Enable?": bool} {all zero or empty}
      w24 = cluster{"t0": f64, "dt": f64, "Y": c128[]} {all zero or empty}
      w4 = w3
      w5 = w23
      w6 = w24
    }
  }
  $"error out" <- w4
  $"Output Bitstream" <- w5
  $"recovered complex waveform" <- w6
