vi "QAM_Rx.gvi"   [LabVIEW NXG 5.1.0]
inputs:
  "QAM Parameters": cluster{"Samples per Symbol": i32, "M": i32}
  "PN sequence order (9)": i32 = 9
  "filter parameters": T2 = {"Alpha"=0.5, "Filter Length"=6, "TX Filter"="Root Raised Cos"}
  "error in (no error)": error
  "synchronization parameters": T4 = {"expected sync location (symbols)"=-1, "sync sequence"=[], "sync location uncertainty (symbols)"=0, "sync indent (symbols)"=0}
  "Sync Bits": i32 = 20
outputs:
  "QAM Init Parameters": T5
  "error out": error
  "bits per symbol": i32
  "Filter Length": i32
types:
  T1 = enum{"none", "Raised Cosine", "Root Raised Cos", "Gaussian"}
  T2 = cluster{"Alpha": f64, "Filter Length": i32, "TX Filter": T1}
  T3 = cluster{"samples per symbol (16)": i32, "symbol map": c128[]}
  T4 = cluster{"expected sync location (symbols)": i32, "sync sequence": c128[], "sync location uncertainty (symbols)": i32, "sync indent (symbols)": i32}
  T5 = cluster{"QAM system parameters": T3, "pulse shaping filter coefficients": f64[], "matched filter coefficients": f64[], "synchronization parameters": T4, "Sync Bits": i8[]}
uses:
  NI::Modulation::MT Generate QAM System Parameters(M).gvi
  NI::Modulation::MT Generate Bits (Galois, PN Order).gvi
  NI::Modulation::MT Generate Filter Coefficients.gvi
  NI::Modulation::MT Map Bits to QAM Symbols.gvi
diagram:
  Property Node(instance in=$"filter parameters") -> ("TX Filter"=w1, "Alpha"=w2, "Filter Length"=w3)
  $"Filter Length" <- w3
  Property Node(instance in=$"QAM Parameters") -> ("Samples per Symbol"=w4, "M"=w5)
  call "MT Generate QAM System Parameters(M).gvi"(samples per symbol=w4, M-QAM=w5, error in=$"error in (no error)") -> (QAM system parameters=w6, bits per symbol=w7, error out=w8)
  call "MT Generate Bits (Galois, PN Order).gvi"(total bits=$"Sync Bits", PN sequence order=$"PN sequence order (9)") -> (output bit stream=w9)
  w10 = "QAM"  # Enum
  call "MT Generate Filter Coefficients.gvi"(filter length=w3, pulse shaping filter=w1, pulse shaping samples per symbol=w4, matched samples per symbol=w4, filter parameter=w2, error in=w8, modulation type=w10) -> (pulse shaping filter coefficients=w11, matched filter coefficients=w12, error out=w13)
  Property Node(instance in=w6) -> ("symbol map"=w14)
  call "MT Map Bits to QAM Symbols.gvi"(input bit stream=w9, symbol map=w14, error in=w13) -> (symbols=w15, error out=w16)
  Property Node(instance in=$"synchronization parameters", "sync sequence"=w15) -> (instance out=w17)
  Property Node(instance in=$"QAM Init Parameters", "QAM system parameters"=w6, "synchronization parameters"=w17, "pulse shaping filter coefficients"=w11, "matched filter coefficients"=w12, "Sync Bits"=w9) -> (instance out=w18)
  $"QAM Init Parameters" <- w18
  $"bits per symbol" <- w7
  $"error out" <- w16
