vi "RSSI(-dBm), SNR(dB).gvi"   [LabVIEW NXG 5.1.0]
inputs:
  "Input Complex Samples": c128[]
  "Bin Size": i32 = 100
  "Use MathScript?": bool
outputs:
  "Energy Threshold": f64
  "noise_estimation_error ?": bool
  "배열타입 RSSI": f64
  "배열타입 SNR": f64
panel indicators:
  "power": f64[600]
diagram:
  Array Size(array=$"Input Complex Samples") -> (size(s)=w1)
  Max And Min(x=w1, y=3000) -> (min(x,y)=w2: i32)
  Quotient And Remainder(x=w2, y=$"Bin Size") -> (floor(x/y)=w3)
  Complex To Polar(r * e^(i*theta)=$"Input Complex Samples") -> (r=w4)
  Square(x=w4) -> w5
  Divide(x=w5, y=$"Bin Size") -> w6
  for (N = w3) (iteration -> i1) {
    Multiply($"Bin Size", i1) -> w8
    Array Subset(array=w6, index0=w8, length0=$"Bin Size") -> w9
    Add Array Elements(numeric array=w9) -> (sum=w10)
    append w10 to w7
  }
  $power <- w7
  Array Max And Min(array=w7) -> (max value=w11, min value=w12)
  Divide(x=w11, y=w12) -> w13
  Logarithm Base 10(x=w13) -> w14
  Multiply(w14, 10) -> w15
  $"배열타입 SNR" <- w15
  Add(w11, w12) -> w16
  Logarithm Base 10(x=w16) -> w17
  Multiply(w17, 10) -> w18
  $"배열타입 RSSI" <- w18
  Divide(x=w11, y=w12) -> w19
  Logarithm Base 10(x=w19) -> w20
  Multiply(w20, 20) -> w21
  Is Less(x=w21, y=3) -> w22
  $"noise_estimation_error ?" <- w22
  Add(w11, w12) -> w23
  Divide(x=w23, y=2) -> w24
  Multiply(w12, 100) -> w25
  Max And Min(x=w24, y=w25) -> (max(x,y)=w26: f64)
  Max And Min(x=1e-06, y=w26) -> (max(x,y)=w27: f64)
  $"Energy Threshold" <- w27
