vi "Recover Message.gvi"   [LabVIEW NXG 5.1.0]
inputs:
  "Input Stream": T1
  "Packet Info": T2
  "Start Loc of Data": i32
outputs:
  "Packet Info out": T2
types:
  T1 = cluster{"bit stream ": i8[][], "Sync Valid?": bool[], "Decoded Pkt Numbers": u32[], "Enable?": bool}
  T2 = cluster{"Packet Array": i32[][], "Packet Received?": bool[]}
diagram:
  Property Node(instance in=$"Input Stream") -> ("Sync Valid?"=w1, "bit stream "=w2, "Decoded Pkt Numbers"=w3, "Enable?"=w4)
  Array Size(array=w1) -> (size(s)=w5)
  case (w4) {
    frame False, Default {
      w6 = $"Packet Info"
    }
    frame True {
      Property Node(instance in=$"Packet Info") -> ("Packet Array"=w7, "Packet Received?"=w8)
      To Signed 32 Bit Integer(number=w2) -> w9
      Array Subset(array=w9, index1=$"Start Loc of Data") -> w10
      To Signed 32 Bit Integer(number=w3) -> w11
      Decrement(x=w11) -> w12
      s1 = w7  # shift register
      s2 = w8  # shift register
      for (N = w5) (iteration -> i1) {
        w13 = each element of w12
        w14 = each element of w1
        Delete From Array(inArray=w10, index0=i1) -> (deleted=w15)
        Array Index(array=s2) -> (out0[w13]=w16)
        Not(x=w16) -> w17
        Logical And(w17, w14) -> w18
        case (w18) {
          frame False, Default {
            w19 = s1
            w20 = s2
          }
          frame True {
            Replace Array Subset(inArray=s1, index=w13, index=_, new=w15) -> w19
            Replace Array Subset(inArray=s2, index=w13, new=TRUE) -> w20
          }
        }
        next s1 = w19
        next s2 = w20
      }
      Property Node(instance in=T2 {all zero or empty}, "Packet Array"=s1, "Packet Received?"=s2) -> (instance out=w6)
    }
  }
  $"Packet Info out" <- w6
