vi "Separate Tokens.gvi"   [LabVIEW NXG 5.1.0]
inputs:
  "Input String": string
  "Token Key": string[] = [":"]
outputs:
  "Text Packet": string
  "Link per delay Token": string
types:
  T1 = cluster{"[0]": string, "[1]": string, "[2]": string, "[3]": string}
diagram:
  Is Empty String Or Path(string/path=$"Input String") -> w1
  case (w1) {
    frame False, Default {
      s1 = string[] []  # shift register
      s2 = 0  # shift register
      while {
        Scan String For Tokens(allow empty tokens=TRUE, delimiters=$"Token Key", input string=$"Input String", offset=s2) -> (offset past token=w4, token string=w5)
        case (w5) {
          frame "" {
            w6 = s1
          }
          frame Default {
            Build Array(s1, w5) -> w6
          }
        }
        Is Greater Or Equal To 0(x=w4) -> w7
        next s1 = w6
        next s2 = w4
        continue if w7
      }
      Array To Cluster[NumberOfClusterElements=4](array=s1) -> (cluster=w8)
      Coerce To Type(type=T1 {all zero or empty}, x=w8) -> w9
      Property Node(instance in=w9) -> ("[0]"=w3, "[1]"=w2)
    }
    frame True {
      w2 = ""
      w3 = ""
    }
  }
  $"Text Packet" <- w3
  $"Link per delay Token" <- w2
