vi "Slot Counter.gvi"   [LabVIEW NXG 5.0.0]
inputs:
  "루프 반복": i32
  "M": enum{"4-QAM", "8-QAM", "16-QAM", "32-QAM"} = "4-QAM"
outputs:
  "Used Slot": i32
diagram:
  case ($M) {
    frame "4-QAM" {
      Increment(x=$"루프 반복") -> w2
      Increment(x=w2) -> w3
      Increment(x=w3) -> w4
      Increment(x=w4) -> w5
      Increment(x=w5) -> w6
      Increment(x=w6) -> w7
      Increment(x=w7) -> w8
      Increment(x=w8) -> w9
      Increment(x=w9) -> w10
      Increment(x=w10) -> w11
      Increment(x=w11) -> w1
    }
    frame "8-QAM" {
      Increment(x=$"루프 반복") -> w12
      Increment(x=w12) -> w13
      Increment(x=w13) -> w14
      Increment(x=w14) -> w15
      Increment(x=w15) -> w16
      Increment(x=w16) -> w17
      Increment(x=w17) -> w18
      Increment(x=w18) -> w19
      Increment(x=w19) -> w20
      Increment(x=w20) -> w21
      Increment(x=w21) -> w1
    }
    frame "16-QAM", Default {
      Increment(x=$"루프 반복") -> w22
      Increment(x=w22) -> w23
      Increment(x=w23) -> w24
      Increment(x=w24) -> w25
      Increment(x=w25) -> w26
      Increment(x=w26) -> w27
      Increment(x=w27) -> w28
      Increment(x=w28) -> w29
      Increment(x=w29) -> w30
      Increment(x=w30) -> w31
      Increment(x=w31) -> w1
    }
    frame "32-QAM" {
      Increment(x=$"루프 반복") -> w32
      Increment(x=w32) -> w33
      Increment(x=w33) -> w34
      Increment(x=w34) -> w35
      Increment(x=w35) -> w36
      Increment(x=w36) -> w37
      Increment(x=w37) -> w38
      Increment(x=w38) -> w1
    }
  }
  $"Used Slot" <- w1
