vi "T_Cac.gvi"   [LabVIEW NXG 5.0.0]
inputs:
  "입력_2": f64
  "입력": f64
  "Link per delay_2": f64
outputs:
  "Link per delay": f64
  "Total delay": f64
diagram:
  $"Link per delay" <- $"Link per delay_2"
  Add($"Link per delay_2", $"입력_2", $"입력") -> w1
  Divide(x=w1, y=180) -> w2
  $"Total delay" <- w2
