vi "check _Power_Spectrum.gvi"   [LabVIEW NXG 5.0.0]
inputs:
  "data": c128[]
  "PowerSpectrumPSDExport": "Power Spectrum PSD Export.gtype" = "Power Spectrum"(0)
outputs:
  "FFT power spectrum density": T1
types:
  T1 = cluster{"f0": f64, "df": f64, "magnitude": f64[]}
  "Power Spectrum PSD Export.gtype" = u16
  T2 = enum{"No averaging", "Vector averaging", "RMS averaging", "Peak hold"}
  T3 = cluster{"averaging mode": T2, "weighting mode": enum{"Linear", "Exponential"}, "number of averages": u32}
uses:
  NI::Analysis::Measurement::Power Spectrum for 1 Chan (CDB).gvi
  NI::Analysis::Measurement::Power Spectral Density for 1 Chan (CDB).gvi
diagram:
  Build Waveform Node(Y=$data) -> (output waveform=w1)
  w2 = T3 {"averaging mode"="No averaging", "weighting mode"="Exponential", "number of averages"=10}
  case ($PowerSpectrumPSDExport) {
    frame 0, Default {
      call "Power Spectrum for 1 Chan (CDB).gvi"(신호=w1, dB On=TRUE, 평균값 연산 파라미터=w2, 평균값 연산 다시 시작=FALSE, 윈도우 타입=1, 윈도우 파라미터=NaN) -> (파워 스펙트럼=w3, 평균값 연산 완료=w4)
    }
    frame 1 {
      # SINAD = P(signal) + P(noise) + P(distortion) / P(noise) + P(distortion)
      call "Power Spectral Density for 1 Chan (CDB).gvi"(신호=w1, dB On=TRUE, 평균값 연산 파라미터=w2, 평균값 연산 다시 시작=FALSE, 윈도우 타입=1, 윈도우 파라미터=NaN) -> (파워 스펙트럼 밀도=w3, 평균값 연산 완료=w5)
    }
  }
  $"FFT power spectrum density" <- w3
