vi "reception of Pac.gvi"   [LabVIEW NXG 5.0.0]
inputs:
  "Packet Received?": bool[]
  "합계": i32
outputs:
  "*prob. Packet Reception": f64
  "Packets received": i16
diagram:
  Boolean To 0 Or 1(Boolean=$"Packet Received?") -> (0, 1=w1)
  Add Array Elements(numeric array=w1) -> (sum=w2)
  $"Packets received" <- w2
  Divide(x=w2, y=$"합계") -> w3
  Multiply(100, w3) -> w4
  $"*prob. Packet Reception" <- w4
