vi "sub_USRP_rx_set.gvi"   [LabVIEW NXG 5.0.0]
inputs:
  "Device IP": string
  "IQ Sampling Rate [S/sec]": f64
  "Carrier Frequency": f64
  "Gain [dB]": f64
  "Active Antenna": string
outputs:
  "출력": "USRP niUSRPClass"
  "출력_2": i64
  "coerced IQ rate": f64
  "출력_3": error
types:
  T1 = cluster{"whole seconds": i32, "fractional seconds": f64}
uses:
  NI::USRP::niUSRP Open Rx Session.gvi
  NI::USRP::niUSRP Configure Signal.gvi
  NI::USRP::niUSRP Set Time.gvi
  NI::USRP::niUSRP Initiate.gvi
diagram:
  call "niUSRP Open Rx Session.gvi"(device names=$"Device IP", reset=TRUE) -> (session handle out=w1, error out=w2)
  call "niUSRP Configure Signal.gvi"(active antenna=$"Active Antenna", session handle=w1, error in=w2, IQ rate=$"IQ Sampling Rate [S/sec]", carrier frequency=$"Carrier Frequency", gain=$"Gain [dB]", channel list="0") -> (session handle out=w3, error out=w4, coerced IQ rate=w5, coerced carrier frequency=w6)
  Add(w5, w6) -> w7
  Property Node(instance in=w3, "niUSRP"="0", "niUSRP"="Internal", "niUSRP"="Internal", "niUSRP"=w7, error in=w4) -> (error out=w8, instance out=w9)
  call "niUSRP Set Time.gvi"(session handle=w9, error in=w8, apply timestamp="Now"(0), timestamp=T1 {all zero or empty}, channel list="0") -> (session handle out=w10, error out=w11)
  call "niUSRP Initiate.gvi"(session handle=w10, error in=w11) -> (session handle out=w12, error out=w13)
  $"출력" <- w12
  Multiply(w5, 0.005) -> w14
  To Signed 64 Bit Integer(number=w14) -> w15
  $"출력_2" <- w15
  $"출력_3" <- w13
  $"coerced IQ rate" <- w5
