vi "sub_multi_rx's_para.gvi"   [LabVIEW NXG 5.1.0]
inputs:
  "원소": string
  "IQ Sampling Rate [S/sec]": f64
  "Carrier Frequency": f64
  "Gain [dB]": f64
  "Active Antenna": string
outputs:
  "출력_4": "niUSRPClass"
  "출력_2": f64
  "출력_3": i64
  "출력": error
uses:
  NI::USRP::niUSRP Open Rx Session.gvi
  NI::USRP::niUSRP Configure Signal.gvi
  NI::USRP::niUSRP Commit.gvi
  NI::USRP::niUSRP Initiate.gvi
diagram:
  call "niUSRP Open Rx Session.gvi"(device names=$"원소", reset=TRUE) -> (session handle out=w1, error out=w2)
  call "niUSRP Configure Signal.gvi"(active antenna=$"Active Antenna", session handle=w1, error in=w2, IQ rate=$"IQ Sampling Rate [S/sec]", carrier frequency=$"Carrier Frequency", gain=$"Gain [dB]", channel list="0") -> (session handle out=w3, error out=w4, coerced IQ rate=w5, coerced carrier frequency=w6)
  Add(w5, w6) -> w7
  Property Node(instance in=w3, "niUSRP"="0", "niUSRP"="Internal", "niUSRP"="Internal", "niUSRP"=w7, error in=w4) -> (error out=w8, instance out=w9)
  call "niUSRP Commit.gvi"(session handle=w9, error in=w8) -> (session handle out=w10, error out=w11)
  call "niUSRP Initiate.gvi"(session handle=w10, error in=w11) -> (session handle out=w12, error out=w13)
  $"출력_4" <- w12
  $"출력" <- w13
  $"출력_2" <- w5
  Multiply(w5, 0.003) -> w14
  To Signed 64 Bit Integer(number=w14) -> w15
  $"출력_3" <- w15
