vi "sub_multiple_rx_para.gvi"   [LabVIEW NXG 5.1.0]
inputs:
  "Modulation Scheme": enum{"4-QAM", "8-QAM", "16-QAM", "32-QAM"} = "4-QAM"
outputs:
  "출력_7": T5
  "출력_4": i32
  "출력_2": T1
  "출력_3": T2
types:
  T1 = cluster{"Guard Bits ": i32, "Sync Bits": i32, "Message Bits": i32, "PN sequence order\nfor Sync Bits": i32, "Packet Expected": i32}
  T2 = cluster{"Packet Array": i32[][], "Packet Received?": bool[]}
  T3 = cluster{"samples per symbol (16)": i32, "symbol map": c128[]}
  T4 = cluster{"expected sync location (symbols)": i32, "sync sequence": c128[], "sync location uncertainty (symbols)": i32, "sync indent (symbols)": i32}
  T5 = cluster{"QAM system parameters": T3, "pulse shaping filter coefficients": f64[], "matched filter coefficients": f64[], "synchronization parameters": T4, "Sync Bits": i8[]}
  T6 = enum{"none", "Raised Cosine", "Root Raised Cos", "Gaussian"}
  T7 = cluster{"Alpha": f64, "Filter Length": i32, "RX Filter": T6}
diagram:
  call "M-QAM parameters.gvi"(M=$"Modulation Scheme") -> (Packet Parameters=w1, Samples per Symbol=w2, M-QAM=w3)
  call "Seperate Packet's Parameters.gvi"(input Packet Parameters=w1, Samples per Symbol=w2, M-QAM=w3) -> (QAM Parameters=w4, PN sequence order (9)=w5, Sync Bits=w6, output Packet Parameters=w7, Message Bits=w8, Packet Expected=w9)
  w10 = T7 {"Alpha"=0.5, "Filter Length"=6, "RX Filter"="Root Raised Cos"}
  w11 = T4 {"expected sync location (symbols)"=-1, "sync sequence"=[], "sync location uncertainty (symbols)"=0, "sync indent (symbols)"=0}
  call "QAM_Rx.gvi"(synchronization parameters=w11, QAM Parameters=w4, filter parameters=w10, PN sequence order (9)=w5, Sync Bits=w6) -> (QAM Init Parameters=w12)
  $"출력_7" <- w12
  Add(32, w6) -> w13
  $"출력_4" <- w13
  $"출력_2" <- w7
  call "Check Packet.gvi"(Message Bits=w8, Packet Expected=w9) -> (Cluster out=w14)
  $"출력_3" <- w14
