vi "sub_out_data_for_rx.gvi"   [LabVIEW NXG 5.1.0]
inputs:
  "입력": path
  "Received Message": string
outputs:
  "Received data [2D-array]": string[][]
uses:
  NI::G Core::File IO (General)::Write Delimited Spreadsheet (string).gvi
diagram:
  Spreadsheet String To Array(array type=string[][] [], delimiter=",", format string="%s", spreadsheet string=$"Received Message") -> (array=w1)
  $"Received data [2D-array]" <- w1
  call "Write Delimited Spreadsheet (string).gvi"(구분 문자=",", 파일=$"입력", 2D 데이터=w1, 파일에 추가=FALSE, 포맷="%s ")
