vi "sub_usrp_rx_list_token_slicing.gvi"   [LabVIEW NXG 5.1.0]
inputs:
  "usrp_list": string[] = ["192.168.10.2", "192.168.10.3", "192.168.10.4", "192.168.10.5", "192.168.10.6"]
outputs:
  "ip_cluster": T1
types:
  T1 = cluster{"[0]": string, "[1]": string, "[2]": string, "[3]": string}
diagram:
  Array To Spreadsheet String(array=$usrp_list, delimiter=";", format string="%s") -> (spreadsheet string=w1)
  Is Empty String Or Path(string/path=w1) -> w2
  case (w2) {
    frame False, Default {
      s1 = string[] []  # shift register
      s2 = 0  # shift register
      while {
        Scan String For Tokens(allow empty tokens=TRUE, delimiters=[";"], input string=w1, offset=s2) -> (offset past token=w4, token string=w5)
        Is Greater Or Equal To 0(x=w4) -> w6
        case (w5) {
          frame "" {
            w7 = s1
          }
          frame Default {
            Build Array(s1, w5) -> w7
          }
        }
        next s1 = w7
        next s2 = w4
        continue if w6
      }
      Array To Cluster[NumberOfClusterElements=4](array=s1) -> (cluster=w8)
      Coerce To Type(type=T1 {all zero or empty}, x=w8) -> w9
      Property Node(instance in=w9) -> (instance out=w3)
    }
    frame True {
      w3 = T1 {all zero or empty}
    }
  }
  $ip_cluster <- w3
