vi "sub_usrp_rx_recept_packet.gvi"   [LabVIEW NXG 5.1.0]
inputs:
  "Packet Received?": bool[]
  "루프 반복": i32
outputs:
  "PACKET RECEPTION [%]": f64
diagram:
  Boolean To 0 Or 1(Boolean=$"Packet Received?") -> (0, 1=w1)
  Add Array Elements(numeric array=w1) -> (sum=w2)
  Divide(x=w2, y=$"루프 반복") -> w3
  Multiply(100, w3) -> w4
  $"PACKET RECEPTION [%]" <- w4
