vi "time_stater.gvi"   [LabVIEW NXG 5.1.0]
outputs:
  "출력": u32
  "출력_2": error
diagram:
  sequence {
    frame 0 {
      call "delay-included processing time.gvi"(불리언=TRUE)
      Tick Count[Units=Microseconds]() -> (timer value=w1)
    }
  }
  $"출력" <- w1
  $"출력_2" <- no error
