vi "Add Pad IQ Waveform.gvi"   [LabVIEW NXG 5.0.0]
inputs:
  "Packet Pad [samples]": i32
  "input complex waveform": cluster{"t0": f64, "dt": f64, "Y": c128[]}
outputs:
  "output complex waveform": cluster{"t0": f64, "dt": f64, "Y": c128[]}
diagram:
  Property Node(instance in=$"input complex waveform") -> ("Y"=w1)
  Initialize Array(element=0+0i, size=$"Packet Pad [samples]") -> w2
  Build Array(w2, w1, w2) -> w3
  Property Node(instance in=$"input complex waveform", "Y"=w3) -> (instance out=w4)
  $"output complex waveform" <- w4
