vi "BPSK modulation.gvi"   [LabVIEW NXG 5.0.0]
inputs:
  "Packet to Transmit": i8[]
  "Symbol Rate, Hz": f64 = 1
  "error in (no error)": error
  "filter parameters": T3 = {"Alpha"=0.5, "Filter Length"=6, "TX Filter"="Root Raised Cos"}
  "PSK system parameters": T1
outputs:
  "output complex waveform": cluster{"t0": f64, "dt": f64, "Y": c128[]}
  "samples per symbol": i32
  "error out": error
types:
  T1 = cluster{"samples per symbol (16)": i32, "symbol map": c128[], "differential PSK": enum{"disable", "enable"}, "PSK type": u16}
  T2 = enum{"none", "Raised Cosine", "Root Raised Cos", "Gaussian"}
  T3 = cluster{"Alpha": f64, "Filter Length": i32, "TX Filter": T2}
uses:
  NI::Modulation::MT Generate Filter Coefficients.gvi
  NI::Modulation::MT Modulate PSK.gvi
diagram:
  case ($"error in (no error)") {
    frame No Error {
      Property Node(instance in=$"PSK system parameters") -> ("samples per symbol (16)"=w1)
      Property Node(instance in=$"filter parameters") -> ("TX Filter"=w4, "Alpha"=w5, "Filter Length"=w6)
      call "MT Generate Filter Coefficients.gvi"(filter length=w6, pulse shaping filter=w4, pulse shaping samples per symbol=w1, matched samples per symbol=w1, filter parameter=w5, error in=$"error in (no error)", modulation type="PSK") -> (pulse shaping filter coefficients=w7, error out=w8)
      call "MT Modulate PSK.gvi"(reset?=TRUE, flush buffers?=TRUE, input bit stream=$"Packet to Transmit", PSK system parameters=$"PSK system parameters", symbol rate=$"Symbol Rate, Hz", pulse shaping filter coefficients=w7, error in=w8) -> (output complex waveform=w2, error out=w3)
    }
    frame Error {
      w1 = default
      w2 = default
      w3 = $"error in (no error)"
    }
  }
  $"samples per symbol" <- w1
  $"output complex waveform" <- w2
  $"error out" <- w3
