vi "Cal Symbol Rate.gvi"   [LabVIEW NXG 5.0.0]
inputs:
  "Samples per Symbol": i32
  "Tx IQ Sampling Rate [s/sec]": f64
outputs:
  "Padding Bits": i32
  "Symbol Rate": f64
diagram:
  To Double Precision Float(number=$"Samples per Symbol") -> w1
  Divide(x=$"Tx IQ Sampling Rate [s/sec]", y=w1) -> w2
  $"Symbol Rate" <- w2
  Logarithm Base 2(x=w1) -> w3
  Divide(x=160, y=w1) -> w4
  Round Toward Positive Infinity(x=w4) -> w5
  Multiply(w5, w3) -> w6
  $"Padding Bits" <- w6
