vi "Cluster_array_sizing.gvi"   [LabVIEW NXG 5.0.0]
inputs:
  "coerced IQ rate": f64 = 100000
outputs:
  "출력": cluster{"t0": f64, "dt": f64, "Y": c128[]}
diagram:
  Initialize Array(element=0+0i, size=100) -> w1
  Reciprocal(x=$"coerced IQ rate") -> w2
  w3 = cluster{"t0": f64, "dt": f64, "Y": c128[]} {all zero or empty}
  Property Node(instance in=w3, "dt"=w2, "Y"=w1) -> (instance out=w4)
  $"출력" <- w4
