vi "Create Packet.gvi"   [LabVIEW NXG 5.0.0]
inputs:
  "Tx IQ Sampling Rate [s/sec]": f64 = 4000000
  "Message Text (Packet)": string = """LabVIEW (Laboratory Virtual Instrument Engineering Workbench)
- a system design platform
- for National Instruments visual programming language

NI-USRP2921 (192.168.10.2 ~ 4)
- 20 MHz bandwidth
- 2.4 GHz to 2.5 GHz and 4.9 GHz to 5.9 GHz

NI-USRP2932 (192.168.10.5 ~ 8)
- 400 MHz to 4.4 GHz, GPS based OCXO"""
  "Pulse Shaping Filter Parameters": T2
  "QAM system parameters": T4 = {"samples per symbol (16)"=16, "symbol map"=[]}  # QAM system parameters cluster groups values defining the PAM system. Wire this control to the corresponding system parameters input of the MT Modulate QAM VI or Demodulate QAM VI.
  "Packet Pad [samples]": i32
  "Packet Parameters": T3
  "User Defined Message?": bool = TRUE
outputs:
  "Number of Packets": i32
  "Packets": cluster{"t0": f64, "dt": f64, "Y": c128[]}[]
types:
  T1 = enum{"none", "Raised Cosine", "Root Raised Cos", "Gaussian"}
  T2 = cluster{"Alpha": f64, "Filter Length": i32, "TX Filter": T1}
  T3 = cluster{"Guard Bits ": i32, "Sync Bits": i32, "Message Bits": i32, "PN sequence order\nfor Sync Bits": i32, "Packet Expected": i32}
  T4 = cluster{"samples per symbol (16)": i32, "symbol map": c128[]}
diagram:
  Property Node(instance in=$"Packet Parameters") -> ("Message Bits"=w1)
  call "Text to BitStream.gvi"(text=$"Message Text (Packet)", Packet Message Length (bits)=w1) -> (message bitstream=w2, Number of Packets=w3)
  Select(s=$"User Defined Message?", t=w3, f=10) -> w4
  $"Number of Packets" <- w4
  Property Node(instance in=$"QAM system parameters") -> ("samples per symbol (16)"=w5)
  call "Cal Symbol Rate.gvi"(Samples per Symbol=w5, Tx IQ Sampling Rate [s/sec]=$"Tx IQ Sampling Rate [s/sec]") -> (Padding Bits=w6, Symbol Rate=w7)
  for (N = w4) (iteration -> i1) {
    call "Packet Array.gvi"(user bitstream=w2, Cyclic Padding Bits=w6, Packet Parameters=$"Packet Parameters", Packet Number=i1, User defined bitstream?=$"User Defined Message?") -> (Output Packet=w9)
    call "QAM Modulation.gvi"(filter parameters=$"Pulse Shaping Filter Parameters", Packet to Transmit=w9, Symbol Rate, Hz=w7, QAM system parameters=$"QAM system parameters") -> (output complex waveform=w10)
    call "Add Pad IQ Waveform.gvi"(Packet Pad [samples]=$"Packet Pad [samples]", input complex waveform=w10) -> (output complex waveform=w11)
    append w11 to w8
  }
  $Packets <- w8
