vi "Enum convertto Int.gvi"   [LabVIEW NXG 5.0.0]
inputs:
  "Input M-QAM": enum{"4-QAM", "8-QAM", "16-QAM", "32-QAM"} = "4-QAM"
outputs:
  "Output M-QAM": i32
diagram:
  # convert enum to M
  Add($"Input M-QAM", 1) -> w1
  Logical Shift(x=2, y=w1) -> w2
  $"Output M-QAM" <- w2
