vi "Packet Array.gvi"   [LabVIEW NXG 5.0.0]
inputs:
  "Packet Parameters": T1 = {"Guard Bits "=0, "Sync Bits"=0, "Message Bits"=0, "PN sequence order\nfor Sync"=9, "Packet Expected"=9}
  "Packet Number": i32
  "User defined bitstream?": bool
  "user bitstream": i8[] = [1]
  "Cyclic Padding Bits": i32
outputs:
  "Output Packet": i8[]
panel indicators:
  "error out": error
types:
  T1 = cluster{"Guard Bits ": i32, "Sync Bits": i32, "Message Bits": i32, "PN sequence order\nfor Sync": i32, "Packet Expected": i32}
uses:
  NI::Modulation::MT Generate Bits (Galois, PN Order).gvi
diagram:
  Property Node(instance in=$"Packet Parameters") -> ("Sync Bits"=w1, "PN sequence order\nfor Sync"=w2, "Guard Bits "=w3, "Message Bits"=w4)
  call "MT Generate Bits (Galois, PN Order).gvi"(reset?=TRUE, total bits=w1, PN sequence order=w2) -> (output bit stream=w5, error out=w6)
  $"error out" <- w6
  case ($"User defined bitstream?") {
    frame False, Default {
      call "MT Generate Bits (Galois, PN Order).gvi"(total bits=w4, PN sequence order=9) -> (output bit stream=w7)
    }
    frame True {
      Multiply($"Packet Number", w4) -> w8
      Array Subset(array=$"user bitstream", index0=w8, length0=w4) -> w7
    }
  }
  Initialize Array(element=1, size=w3) -> w9
  Increment(x=$"Packet Number") -> w10
  Number To Boolean Array(number=w10) -> (Boolean array=w11)
  Boolean To 0 Or 1(Boolean=w11) -> (0, 1=w12)
  To Signed 8 Bit Integer(number=w12) -> w13
  # w13: Create Packet Header
  Build Array(w9, w5, w13, w7, w13, w13) -> w14
  $"Output Packet" <- w14
  Array Size(array=w14)
  Array Subset(array=w7, length0=$"Cyclic Padding Bits")
