vi "Pro-perty.gvi"   [LabVIEW NXG 5.0.0]
inputs:
  "session handle out": "USRP niUSRPClass"
  "coerced IQ rate": f64 = 100000
  "coerced carrier frequency": f64 = 100000
  "error out": error
outputs:
  "session handle": "USRP niUSRPClass"
  "error in": error
diagram:
  Add($"coerced IQ rate", $"coerced carrier frequency") -> w1
  Property Node(instance in=$"session handle out", "niUSRP"="0", "niUSRP"="Internal", "niUSRP"="Internal", "niUSRP"=w1, error in=$"error out") -> (error out=w2, instance out=w3)
  $"session handle" <- w3
  $"error in" <- w2
