vi "Start delay + Well known Abort delay.gvi"   [LabVIEW NXG 5.0.0]
inputs:
  "start": u32
outputs:
  "start delay": f64
  "x > 0?": bool
uses:
  NI::G Core::Numeric::Random Number (Range) DBL.gvi
diagram:
  call "Random Number (Range) DBL.gvi"(상위 경계=0.2, 하위 경계=0.02) -> (숫자=w1)
  Tick Count[Units=Microseconds]() -> (timer value=w2)
  # w1: well known delay time
  Subtract(x=w2, y=$start) -> w3
  Divide(x=w3, y=1000000) -> w4
  Add(w4, 0.02, w1) -> w5
  Is Greater Than 0(x=w5) -> w6
  $"x > 0?" <- w6
  $"start delay" <- w5
