vi "Text to BitStream.gvi"   [LabVIEW NXG 5.0.0]
inputs:
  "text": string
  "Packet Message Length (bits)": i32
outputs:
  "message bitstream": i8[]
  "File Length (bits)": i32
  "Number of Packets": i32
panel indicators:
  "Array": i8[][]
diagram:
  String To Byte Array(encoding="Extended ASCII", string=$text) -> (unsigned byte array=w1)
  for {
    w2 = each element of w1
    Number To Boolean Array(number=w2) -> (Boolean array=w4)
    Boolean To 0 Or 1(Boolean=w4) -> (0, 1=w5)
    append w5 to w3
  }
  To Signed 8 Bit Integer(number=w3) -> w6
  Array Size(array=w6) -> (size(s)=w7)
  Multiply Array Elements(numeric array=w7) -> (product=w8)
  Reshape Array(inArray=w6, size=w8) -> w9
  Array Size(array=w9) -> (size(s)=w10)
  $"File Length (bits)" <- w10
  Divide(x=w10, y=$"Packet Message Length (bits)") -> w11
  Round Toward Positive Infinity(x=w11) -> w12
  To Signed 32 Bit Integer(number=w12) -> w13
  $"Number of Packets" <- w13
  $Array <- w6
  Multiply(w12, $"Packet Message Length (bits)") -> w14
  Subtract(x=w14, y=w10) -> w15
  To Signed 32 Bit Integer(number=w15) -> w16
  Initialize Array(element=0, size=w16) -> w17
  Build Array(w9, w17) -> w18
  $"message bitstream" <- w18
