vi "sub_USRP_tx_set.gvi"   [LabVIEW NXG 5.1.0]
inputs:
  "Device IP": string
  "IQ Sampling Rate [S/sec]": f64
  "Carrier Frequency": f64
  "Gain [dB]": f64
  "Active Antenna": string
outputs:
  "출력": "niUSRPClass"
  "출력_3": cluster{"t0": f64, "dt": f64, "Y": c128[]}
  "출력_2": error
  "coerced IQ rate": f64
types:
  "niUSRP Timestamp.gtype" = cluster{"whole seconds": u64, "fractional seconds": f64}
  T1 = cluster{"whole seconds": i32, "fractional seconds": f64}
uses:
  NI::USRP::niUSRP Open Tx Session.gvi
  NI::USRP::niUSRP Configure Time Start Trigger.gvi
  NI::USRP::niUSRP Configure Signal.gvi
  NI::USRP::niUSRP Commit.gvi
  NI::USRP::niUSRP Set Time.gvi
diagram:
  call "niUSRP Open Tx Session.gvi"(device names=$"Device IP", reset=TRUE) -> (session handle out=w1, error out=w2)
  w3 = "niUSRP Timestamp.gtype" {"whole seconds"=1, "fractional seconds"=0}
  call "niUSRP Configure Time Start Trigger.gvi"(session handle=w1, error in=w2, start trigger time=w3) -> (session handle out=w4, error out=w5)
  call "niUSRP Configure Signal.gvi"(active antenna=$"Active Antenna", session handle=w4, error in=w5, IQ rate=$"IQ Sampling Rate [S/sec]", carrier frequency=$"Carrier Frequency", gain=$"Gain [dB]", channel list="0") -> (session handle out=w6, error out=w7, coerced IQ rate=w8)
  Property Node(instance in=w6, sub-item="0", "niUSRP"="0", "niUSRP"="Internal", "niUSRP"="Internal", error in=w7) -> (error out=w9, instance out=w10)
  call "niUSRP Commit.gvi"(session handle=w10, error in=w9) -> (session handle out=w11, error out=w12)
  call "niUSRP Set Time.gvi"(session handle=w11, error in=w12, apply timestamp="Now"(0), timestamp=T1 {all zero or empty}, channel list="0") -> (session handle out=w13, error out=w14)
  $"출력" <- w13
  $"출력_2" <- w14
  $"coerced IQ rate" <- w8
  Reciprocal(x=w8) -> w15
  Initialize Array(element=0+0i, size=100) -> w16
  w17 = cluster{"t0": f64, "dt": f64, "Y": c128[]} {all zero or empty}
  Property Node(instance in=w17, "dt"=w15, "Y"=w16) -> (instance out=w18)
  $"출력_3" <- w18
