vi "sub_load_data_for_tx.gvi"   [LabVIEW NXG 5.0.0]
inputs:
  "file path": path
outputs:
  "read .csv [sensor data]": string[][]
  "Message Text (Packet)": string
uses:
  NI::G Core::File IO (General)::Read Delimited Spreadsheet (string).gvi
diagram:
  call "Read Delimited Spreadsheet (string).gvi"(구분 문자=",", 파일=$"file path", 포맷="%s") -> (모든 행=w1)
  $"read .csv [sensor data]" <- w1
  Array To Spreadsheet String(array=w1, delimiter=",", format string="%s") -> (spreadsheet string=w2)
  $"Message Text (Packet)" <- w2
