vi "sub_usrp_tx_constellation.gvi"   [LabVIEW NXG 5.1.0]
inputs:
  "입력": cluster{"t0": f64, "dt": f64, "Y": c128[]}
  "입력_2": i32
outputs:
  "Source I/Q Constellation": T1[]
types:
  T1 = cluster{"constellation": f64[], "oversampled data": f64[]}
uses:
  NI::Modulation::MT Add AWGN.gvi
  NI::Modulation::MT Format Constellation.gvi
diagram:
  call "MT Add AWGN.gvi"(input complex waveform=$"입력", samples per symbol=8, bits per symbol=$"입력_2", eb/n0=28) -> (output complex waveform=w1)
  call "MT Format Constellation.gvi"(waveform=w1, samples per symbol=8, offset=8) -> (constellation graph=w2)
  $"Source I/Q Constellation" <- w2
