vi "sub_usrp_tx_esc.gvi"   [LabVIEW NXG 5.1.0]
inputs:
  "입력_3": Queue<cluster{"t0": f64, "dt": f64, "Y": c128[]}>
  "입력": "niUSRPClass"
  "입력_4": error
  "입력_2": error
uses:
  NI::USRP::niUSRP Close Session.gvi
  NI::G Core::Error::Legacy::Simple Error Handler.gvi
diagram:
  call "niUSRP Close Session.gvi"(session handle=$"입력", error in=$"입력_4") -> (error out=w1)
  Release Queue(error in=$"입력_2", queue=$"입력_3") -> (error out=w2)
  Merge Errors(w2, w1) -> (error out=w3)
  call "Simple Error Handler.gvi"(에러 입력=w3)
