vi "sub_usrp_tx_master.gvi"   [LabVIEW NXG 5.1.0]
inputs:
  "입력_4": Queue<cluster{"t0": f64, "dt": f64, "Y": c128[]}>
  "입력_2": cluster{"t0": f64, "dt": f64, "Y": c128[]}[]
  "루프 반복": i32
  "입력_3": i32
  "입력": error
outputs:
  "출력_3": Queue<cluster{"t0": f64, "dt": f64, "Y": c128[]}>
  "출력_2": cluster{"t0": f64, "dt": f64, "Y": c128[]}
  "선택자": bool
  "출력": error
diagram:
  Quotient And Remainder(x=$"루프 반복", y=$"입력_3") -> (x-y*floor(x/y)=w1)
  Array Index(array=$"입력_2") -> (out0[w1]=w2)
  $"출력_2" <- w2
  Get Queue Status(error in=$"입력", queue=$"입력_4") -> (# elements in queue=w3, error out=w4, max queue size=w5, queue out=w6)
  $"출력" <- w4
  $"출력_3" <- w6
  Is Less(x=w3, y=w5) -> w7
  $"선택자" <- w7
