vi "sub_usrp_tx_ready.gvi"   [LabVIEW NXG 5.1.0]
inputs:
  "루프 반복": i32
  "stop": bool
outputs:
  "Ready": bool
diagram:
  Is Greater Than 0(x=$"루프 반복") -> w1
  Not(x=$stop) -> w2
  Logical And(w1, w2) -> w3
  $Ready <- w3
