vi "sub_usrp_tx_slave.gvi"   [LabVIEW NXG 5.1.0]
inputs:
  "입력_2": Queue<cluster{"t0": f64, "dt": f64, "Y": c128[]}>
  "입력": error
outputs:
  "출력": Queue<cluster{"t0": f64, "dt": f64, "Y": c128[]}>
  "선택자": bool
  "출력_2": error
diagram:
  Get Queue Status(error in=$"입력", queue=$"입력_2") -> (# elements in queue=w1, error out=w2, queue out=w3)
  $"출력" <- w3
  $"출력_2" <- w2
  Is Equal To 0(x=w1) -> w4
  $"선택자" <- w4
