vi "Main_Destination (NI-USRP).gvi"   [LabVIEW NXG 5.1.0]
panel controls:
  "NI-USRP RX OPTIONS": T1 = {"Device IP"="192.168.10.3", "Modulation Scheme"="16-QAM", "IQ Sampling\nRate [S/sec]"=2000000, "Carrier Frequency"=2400000000, "Gain [dB]"=22, "Active Antenna"="RX2", "Time slot[µs]"=500, "Idle time[µs]"=500, "Thread_slot"=60, "AWGN[Eb/N0]"=35}
  "stop": bool
  "[Destination] Received data file": path = path "C:\\Users\\duddn\\Desktop\\SDR_reception_data.csv"
panel indicators:
  "*Prob. Packet Reception": f64
  "Received packet": i16
  "SNR [dB]": f64
  "OK Packet Header": bool[]
  "Total delay": f64
  "I/Q Signal-based constellation": T2[]
  "Link per delay": f64
  "RSSI [dBm]": f64
  "Allocated slot": i32
  "Received excel data": string[][]
types:
  T1 = cluster{"Device IP": string, "Modulation Scheme": enum{"4-QAM", "8-QAM", "16-QAM", "32-QAM"}, "IQ Sampling\nRate [S/sec]": f64, "Carrier Frequency": f64, "Gain [dB]": f64, "Active Antenna": string, "Time slot[µs]": f64, "Idle time[µs]": f64, "Thread_slot": i32, "AWGN[Eb/N0]": f64}
  T2 = cluster{"constellation": f64[], "oversampled data": f64[]}
  T3 = enum{"none", "Raised Cosine", "Root Raised Cos", "Gaussian"}
  T4 = cluster{"Alpha": f64, "Filter Length": i32, "RX Filter": T3}
  T5 = cluster{"expected sync location (symbols)": i32, "sync sequence": c128[], "sync location uncertainty (symbols)": i32, "sync indent (symbols)": i32}
  T6 = cluster{"bit stream ": i8[][], "Sync Valid?": bool[], "Decoded Pkt Numbers": u32[], "Enable?": bool}
  T7 = cluster{"packet_arr": c128[][], "Packets Valid?": bool}
uses:
  NI::Modulation::MT Format Constellation.gvi
  NI::USRP::niUSRP Fetch Rx Data (CDB Cluster).gvi
  NI::USRP::niUSRP Abort.gvi
  NI::USRP::niUSRP Close Session.gvi
  NI::G Core::Error::Display Error.gvi
diagram:
  Property Node(instance in=$"NI-USRP RX OPTIONS") -> ("Device IP"=w1, "Modulation Scheme"=w2, "IQ Sampling\nRate [S/sec]"=w3, "Carrier Frequency"=w4, "Gain [dB]"=w5, "Active Antenna"=w6, "Time slot[µs]"=w7, "Thread_slot"=w8)
  call "sub_USRP_rx_set.gvi"(Device IP=w1, IQ Sampling Rate [S/sec]=w3, Carrier Frequency=w4, Gain [dB]=w5, Active Antenna=w6) -> (출력=w9, 출력_2=w10, coerced IQ rate=w11, 출력_3=w12)
  call "M-QAM parameters.gvi"(M=w2) -> (Packet Parameters=w13, Samples per Symbol=w14, M-QAM=w15)
  call "Seperate Packet's Parameters.gvi"(input Packet Parameters=w13, Samples per Symbol=w14, M-QAM=w15) -> (QAM Parameters=w16, PN sequence order (9)=w17, Sync Bits=w18, output Packet Parameters=w19, Message Bits=w20, Packet Expected=w21)
  call "throughput, symrate.gvi"(M-QAM=w15, coerced IQ rate=w11, Samples per symbol=w14) -> (Symbol rate[sym/sec]=w22)
  w23 = T4 {"Alpha"=0.5, "Filter Length"=6, "RX Filter"="Root Raised Cos"}
  w24 = T5 {"expected sync location (symbols)"=-1, "sync sequence"=[], "sync location uncertainty (symbols)"=0, "sync indent (symbols)"=0}
  call "QAM_Rx.gvi"(synchronization parameters=w24, QAM Parameters=w16, filter parameters=w23, PN sequence order (9)=w17, Sync Bits=w18, error in (no error)=no error) -> (QAM Init Parameters=w25, Filter Length=w26)
  call "Check Packet.gvi"(Message Bits=w20, Packet Expected=w21) -> (Cluster out=w27)
  Add(32, w18) -> w28
  w29 = $"[Destination] Received data file"
  call "time_stater.gvi"() -> (출력_2=w30, 출력=w31)
  w32 = cluster{"bit stream": i8[][], "Enable?": bool} {all zero or empty}
  w33 = cluster{"t0": f64, "dt": f64, "Y": c128[]} {all zero or empty}
  s1 = w12  # shift register
  s2 = w27  # shift register
  s3 = T7 {all zero or empty}  # shift register
  s4 = w32  # shift register
  s5 = T6 {all zero or empty}  # shift register
  s6 = w33  # shift register
  while (iteration -> i1) (after w30) (after w22) {
    Property Node(instance in=w25) -> (instance out=w34)
    call "QAM Demodulation.gvi"(Input Packets=s3, Rx dt=w11, QAM Init Parameters=w34) -> (Output Bitstream=w35, recovered complex waveform=w36)
    call "FilterCPLX.gvi"(waveform to truncate=w36, filter length (symbols)=w26, samples per symbol (16)=8) -> (truncated waveform=w37)
    call "MT Format Constellation.gvi"(waveform=w37, samples per symbol=8, offset=8) -> (constellation graph=w38)
    $"I/Q Signal-based constellation" <- w38
    call "Packet_Validity.gvi"(QAM Init Parameters=w25, Input Bit Stream=s4, Packet Parameters=w19) -> (Output Bit Stream=w39)
    call "Chop_Shell.gvi"(data=s6) -> (SNR=w40, Output Packets=w41, RSSI=w42)
    $"RSSI [dBm]" <- w42
    $"SNR [dB]" <- w40
    call "Recover Message.gvi"(Input Stream=s5, Packet Info=s2, Start Loc of Data=w28) -> (Packet Info out=w43)
    Property Node(instance in=w43) -> ("Packet Array"=w44, "Packet Received?"=w45, instance out=w46)
    call "Format_Data.gvi"(Output Packet Array=w44) -> (Received Message=w47)
    call "sub_out_data_for_rx.gvi"(입력=w29, Received Message=w47) -> (Received data [2D-array]=w48)
    $"Received excel data" <- w48
    call "Slot Counter.gvi"(M=w2, 루프 반복=i1) -> (Used Slot=w49)
    call "reception of Pac.gvi"(Packet Received?=w45, 합계=w49) -> (*prob. Packet Reception=w50, Packets received=w51)
    $"*Prob. Packet Reception" <- w50
    $"OK Packet Header" <- w45
    $"Received packet" <- w51
    $"Allocated slot" <- w49
    call "niUSRP Fetch Rx Data (CDB Cluster).gvi"(session handle=w9, error in=s1, number of samples=w10, timeout=3, channel list="0") -> (session handle out=w52, error out=w53, data=w54)
    Is Equal(x=w49, y=w8) -> w55
    And Array Elements(Boolean array=w45) -> (logical AND=w56)
    Logical Or(w56, w55, w53, $stop) -> w57
    Divide(x=w7, y=1000000) -> w58
    call "High Resolution Polling Wait.gvi"(seconds to wait=w58)
    call "Start delay + Well known Abort delay.gvi"(start=w31) -> (start delay=w59)
    call "delay-included processing time.gvi"(불리언=FALSE) -> (Timer[sec]=w60)
    call "T_Cac.gvi"(입력=w60, 입력_2=w59) -> (Link per delay=w61, Total delay=w62)
    $"Link per delay" <- w61
    $"Total delay" <- w62
    next s1 = w53
    next s2 = w46
    next s3 = w41
    next s4 = w35
    next s5 = w39
    next s6 = w54
    stop if w57
  }
  call "niUSRP Abort.gvi"(session handle=w52, error in=s1) -> (session handle out=w63, error out=w64)
  call "niUSRP Close Session.gvi"(session handle=w63, error in=w64) -> (error out=w65)
  call "Display Error.gvi"(에러 입력=w65)
