vi "Main_Source (NI-USRP).gvi"   [LabVIEW NXG 5.0.0]
panel controls:
  "stop": bool
  "NI-USRP TX OPTIONS": T2 = {"Device IP"="192.168.10.2", "Modulation Scheme"="16-QAM", "IQ Sampling\nRate [S/sec]"=2000000, "Carrier Frequency"=2400000000, "Gain [dB]"=22, "Active Antenna"="TX1", "Channel"="0", "Exit time"=15}
  "file path": path = path "C:\\Users\\duddn\\Desktop\\SDR_transmission_data.csv"
panel indicators:
  "에러": error
  "IQ Graph": T1[]
  "Ready": bool
  "read .csv [sensor data]": string[][]
types:
  T1 = cluster{"constellation": f64[], "oversampled data": f64[]}
  T2 = cluster{"Device IP": string, "Modulation Scheme": enum{"4-QAM", "8-QAM", "16-QAM", "32-QAM"}, "IQ Sampling\nRate [S/sec]": f64, "Carrier Frequency": f64, "Gain [dB]": f64, "Active Antenna": string, "Channel": string, "Exit time": f64}
  T3 = enum{"none", "Raised Cosine", "Root Raised Cos", "Gaussian"}
  T4 = cluster{"Alpha": f64, "Filter Length": i32, "TX Filter": T3}
uses:
  NI::Modulation::MT Generate QAM System Parameters(M).gvi
  NI::Modulation::MT Add AWGN.gvi
  NI::Modulation::MT Format Constellation.gvi
  NI::USRP::niUSRP Write Tx Data (CDB Cluster).gvi
  NI::USRP::niUSRP Close Session.gvi
  NI::G Core::Error::Legacy::Simple Error Handler.gvi
diagram:
  sequence {
    frame 0 {
      call "sub_load_data_for_tx.gvi"(file path=$"file path") -> (read .csv [sensor data]=w1, Message Text (Packet)=w2)
      $"read .csv [sensor data]" <- w1
    }
  }
  Property Node(instance in=$"NI-USRP TX OPTIONS") -> ("Device IP"=w3, "Modulation Scheme"=w4, "IQ Sampling\nRate [S/sec]"=w5, "Carrier Frequency"=w6, "Gain [dB]"=w7, "Active Antenna"=w8, "Exit time"=w9)
  call "M-QAM parameters.gvi"(M=w4) -> (Packet Parameters=w10, Samples per Symbol=w11, M-QAM=w12)
  call "MT Generate QAM System Parameters(M).gvi"(samples per symbol=w11, M-QAM=w12) -> (QAM system parameters=w13)
  call "Create Packet.gvi"(Packet Parameters=w10, QAM system parameters=w13, Pulse Shaping Filter Parameters=T4 {"Alpha"=0.5, "Filter Length"=6, "TX Filter"="none"}, Packet Pad [samples]=100, Message Text (Packet)=w2) -> (Packets=w14, Number of Packets=w15)
  w16 = cluster{"t0": f64, "dt": f64, "Y": c128[]} {all zero or empty}
  Obtain Queue(element data type=w16, max queue size=20) -> (error out=w17, queue out=w18)
  while (iteration -> i1) {
    Get Queue Status(error in=w17, queue=w18) -> (# elements in queue=w19, error out=w20, max queue size=w21, queue out=w22)
    Quotient And Remainder(x=i1, y=w15) -> (x-y*floor(x/y)=w23)
    Array Index(array=w14) -> (out0[w23]=w24)
    Is Less(x=w19, y=w21) -> w25
    case (w25) {
      frame False, Default {
        Wait Until Next Multiple(multiple to wait=0)
        w26 = w20
      }
      frame True {
        Enqueue Element(element=w24, error in=w20, queue=w22) -> (error out=w26)
        call "MT Add AWGN.gvi"(input complex waveform=w24, samples per symbol=8, eb/n0=35, error in=w20) -> (output complex waveform=w27, error out=w28)
        call "MT Format Constellation.gvi"(waveform=w27, samples per symbol=8, offset=8, error in=w28) -> (constellation graph=w29)
        $"IQ Graph" <- w29
      }
    }
    stop if w26
  }
  call "sub_USRP_tx_set.gvi"(Device IP=w3, IQ Sampling Rate [S/sec]=w5, Carrier Frequency=w6, Gain [dB]=w7, Active Antenna=w8) -> (출력=w30, 출력_2=w31, coerced IQ rate=w32)
  call "Cluster_array_sizing.gvi"(coerced IQ rate=w32) -> (출력=w33)
  Get Current Time() -> (current time=w34)
  while (iteration -> i2) {
    call "check_ready_time.gvi"(입력_2=w34, 입력=w9) -> (입력 3=w35)
    Get Queue Status(error in=w17, queue=w18) -> (# elements in queue=w36, error out=w37, queue out=w38)
    Is Equal To 0(x=w36) -> w39
    case (w39) {
      frame False, Default {
        Dequeue Element(error in=w37, queue=w38) -> (element=w40, error out=w42, queue out=w41)
      }
      frame True {
        Wait Until Next Multiple(multiple to wait=0)
        w40 = w33
        w41 = w38
        w42 = w37
      }
    }
    call "niUSRP Write Tx Data (CDB Cluster).gvi"(session handle=w30, error in=w31, data=w40, timeout=5, end of data?=$stop, channel list="0") -> (session handle out=w43, error out=w44)
    Logical Or(w42, w44, $stop, w35) -> w45
    Not(x=$stop) -> w46
    Is Greater Than 0(x=i2) -> w47
    Logical And(w47, w46) -> w48
    $Ready <- w48
    stop if w45
  }
  call "niUSRP Close Session.gvi"(session handle=w43, error in=w44) -> (error out=w49)
  Release Queue(error in=w42, queue=w41) -> (error out=w50)
  Merge Errors(w50, w49) -> (error out=w51)
  call "Simple Error Handler.gvi"(에러 입력=w51) -> (에러 출력=w52)
  $"에러" <- w52
