vi "TDMA-based multi-hop relay network (channel sounding version).gvi"   [LabVIEW NXG 5.0.0]
panel controls:
  "stop": bool
  "탭": i32
  "NI-USRP 2921 (half-duplex, tx : 35 dB, rx : 92.5 dB)": i32
  "usrp_tx_options": T2 = {"Active Antenna"="TX1", "padding samples"=800, "Modulation Scheme"="16-QAM", "IQ Sampling\nRate [S/sec]"=2000000, "Carrier Frequency"=2400000000, "Gain [dB]"=23, "Exit time"=10}
  "usrp_rx_options": T3 = {"Active Antenna"="RX2", "Max_slot"=20, "Modulation Scheme"="16-QAM", "IQ Sampling\nRate [S/sec]"=2000000, "Carrier Frequency"=2400000000, "Gain [dB]"=23, "Time slot[µs]"=500, "Idle time[µs]"=500}
  "usrp_list": string[] = ["192.168.10.2", "192.168.10.3", "192.168.10.4", "192.168.10.5", "192.168.10.6"]
  "RSSI [-dBm]": f64[][]
  "Prob. packet reception [%]": f64[][]
  "SNR [dB]": f64[][]
  "Priority": i32 = "SNR (dB)"(0)
  "Routing scheme": i32 = "Best-hop"(0)
  "탭_2": i32
  "탭_3": i32
  "stop_2": bool
panel indicators:
  "[0-1] constellation": T1[]
  "[0-2] constellation": T1[]
  "[0-3] constellation": T1[]
  "OK PACKET HEADER": bool[]
  "OK packet header_2": bool[]
  "OK packet header_3": bool[]
  "[0] ready": bool
  "[0-n] S. constellation": T1[]
  "[0-4] constellation": T1[]
  "OK packet header_4": bool[]
  "[1-2] constellation": T1[]
  "OK PACKET HEADER_5": bool[]
  "[1-3] constellation": T1[]
  "OK packet header_6": bool[]
  "[1-4] constellation": T1[]
  "OK packet header_7": bool[]
  "[2-3] constellation": T1[]
  "OK PACKET HEADER_8": bool[]
  "[2-4] constellation": T1[]
  "OK packet header_9": bool[]
  "[3-4] constellation": T1[]
  "OK PACKET HEADER_10": bool[]
  "[3-4] END": bool
  "[2-3] END": bool
  "[2-4] END": bool
  "[1-2] END": bool
  "[1-3] END": bool
  "[1-4] END": bool
  "[0-1] END": bool
  "[0-2] END": bool
  "[0-3] END": bool
  "[0-4] END": bool
  "[1] ready": bool
  "[1-n] S. constellation": T1[]
  "[2] ready": bool
  "[2-n] S. constellation": T1[]
  "[3] ready": bool
  "[3-n] S. constellation": T1[]
  "[0-1] RSSI": f64
  "[0-1] SNR": f64
  "[0-1] prob. of reception": f64
  "[0-2] prob. of reception": f64
  "[0-2] RSSI": f64
  "[0-2] SNR": f64
  "[0-3] prob. of reception": f64
  "[0-3] RSSI": f64
  "[0-3] SNR": f64
  "[0-4] prob. of reception": f64
  "[0-4] RSSI": f64
  "[0-4] SNR": f64
  "[1-2] RSSI": f64
  "[1-2] SNR": f64
  "[1-2] prob. of reception": f64
  "[1-3] prob. of reception": f64
  "[1-3] RSSI": f64
  "[1-3] SNR": f64
  "[1-4] RSSI": f64
  "[1-4] SNR": f64
  "[1-4] prob. of reception": f64
  "[2-3] prob. of reception": f64
  "[2-3] RSSI": f64
  "[2-3] SNR": f64
  "[2-4] RSSI": f64
  "[2-4] SNR": f64
  "[2-4] prob. of reception": f64
  "[3-4] prob. of reception": f64
  "[3-4] RSSI": f64
  "[3-4] SNR": f64
  "[0-1] delay": f64
  "[0-2] delay": f64
  "[0-3] delay": f64
  "[0-4] delay": f64
  "[1-2] delay": f64
  "[1-3] delay": f64
  "[1-4] delay": f64
  "[2-3] delay": f64
  "[2-4] delay": f64
  "[3-4] delay": f64
  "Per link delay": f64[][]
  "Performance?": bool
  "[0 to n] optimal path": T4
  "[1 to n] optimal path": T4
  "[2 to n] optimal path": T4
  "[3 to n] optimal path": T4
  "Array w/o Duplicates": string[]
  "generated table": bool
  "[0-3] received siganl": f64[]
  "[0-4] received siganl": f64[]
  "[0-1] received siganl": f64[]
  "[0-2] received siganl": f64[]
  "[3-4] received siganl": f64[]
  "[2-3] received siganl": f64[]
  "[2-4] received siganl": f64[]
  "[1-4] received siganl": f64[]
  "[1-2] received siganl": f64[]
  "[1-3] received siganl": f64[]
  "[3-4] spectrum": T5
  "[2-3] spectrum": T5
  "[2-4] spectrum": T5
  "[1-4] spectrum": T5
  "[1-2] spectrum": T5
  "[1-3] spectrum": T5
  "[0-3] spectrum": T5
  "[0-4] spectrum": T5
  "[0-1] spectrum": T5
  "[0-2] spectrum": T5
  "[D] ready": bool
  "[0-n] S. constellation_2": T1[]
  "[D] constellation": T1[]
  "Destination": bool[]
  "[D] END": bool
  "[D] RSSI": f64
  "[D] SNR": f64
  "[D] prob. of packet reception (%)": f64
  "[D] delay": f64
  "[D] received signal": f64[]
  "[D] Power spectrum": T5
  "[D] Received Message": string
types:
  T1 = cluster{"constellation": f64[], "oversampled data": f64[]}
  T2 = cluster{"Active Antenna": string, "padding samples": i32, "Modulation Scheme": enum{"4-QAM", "8-QAM", "16-QAM", "32-QAM"}, "IQ Sampling\nRate [S/sec]": f64, "Carrier Frequency": f64, "Gain [dB]": f64, "Exit time": f64}
  T3 = cluster{"Active Antenna": string, "Max_slot": i32, "Modulation Scheme": enum{"4-QAM", "8-QAM", "16-QAM", "32-QAM"}, "IQ Sampling\nRate [S/sec]": f64, "Carrier Frequency": f64, "Gain [dB]": f64, "Time slot[µs]": f64, "Idle time[µs]": f64}
  T4 = cluster{"source": string, "optimal-hop": string, "performance": f64}
  T5 = cluster{"f0": f64, "df": f64, "magnitude": f64[]}
  T6 = cluster{"packet_arr": c128[][], "Packets Valid?": bool}
  T7 = cluster{"bit stream ": i8[][], "Sync Valid?": bool[], "Decoded Pkt Numbers": u32[], "Enable?": bool}
  T8 = enum{"none", "Raised Cosine", "Root Raised Cos", "Gaussian"}
  T9 = cluster{"Alpha": f64, "Filter Length": i32, "TX Filter": T8}
uses:
  NI::USRP::niUSRP Fetch Rx Data (CDB Cluster).gvi
  NI::Modulation::MT Format Constellation.gvi
  NI::USRP::niUSRP Fetch Rx Data (CDB).gvi
  NI::USRP::niUSRP Write Tx Data (CDB Cluster).gvi
diagram:
  w1 = $usrp_list
  s1 = 0  # shift register
  while {
    Logical And($"[0] ready", $"[1] ready", $"[2] ready", $"[3] ready", $"[3-4] END") -> w2
    call "sub_initial_usrp_tx_rx_idx.gvi"(register_idx(tx)=s1, usrp_list=w1) -> (register_idx(rx)=w3, selected_tx_usrp=w4)
    case (w3) {
      frame 1, Default {
        sequence {
          frame 0 {
            Property Node(instance in=$usrp_rx_options) -> ("Modulation Scheme"=w5, "IQ Sampling\nRate [S/sec]"=w6, "Carrier Frequency"=w7, "Gain [dB]"=w8, "Active Antenna"=w9, "Time slot[µs]"=w10, "Max_slot"=w11)
            call "sub_multiple_rx_para.gvi"(Modulation Scheme=w5) -> (출력_7=w12, 출력_4=w13, 출력_2=w14, 출력_3=w15)
            call "sub_multiple_rx_para.gvi"(Modulation Scheme=w5) -> (출력_7=w16, 출력_4=w17, 출력_2=w18, 출력_3=w19)
            call "sub_multiple_rx_para.gvi"(Modulation Scheme=w5) -> (출력_7=w20, 출력_4=w21, 출력_2=w22, 출력_3=w23)
            call "sub_multiple_rx_para.gvi"(Modulation Scheme=w5) -> (출력_7=w24, 출력_4=w25, 출력_2=w26, 출력_3=w27)
            call "sub_multi_rx's_para.gvi"(원소="192.168.10.5", IQ Sampling Rate [S/sec]=w6, Carrier Frequency=w7, Gain [dB]=w8, Active Antenna=w9) -> (출력_4=w28, 출력_2=w29, 출력_3=w30)
            call "sub_multi_rx's_para.gvi"(원소="192.168.10.6", IQ Sampling Rate [S/sec]=w6, Carrier Frequency=w7, Gain [dB]=w8, Active Antenna=w9) -> (출력_4=w31, 출력_2=w32, 출력_3=w33)
            call "sub_multi_rx's_para.gvi"(원소="192.168.10.3", IQ Sampling Rate [S/sec]=w6, Carrier Frequency=w7, Gain [dB]=w8, Active Antenna=w9) -> (출력_4=w34, 출력_2=w35, 출력_3=w36, 출력=w37)
            call "sub_multi_rx's_para.gvi"(원소="192.168.10.4", IQ Sampling Rate [S/sec]=w6, Carrier Frequency=w7, Gain [dB]=w8, Active Antenna=w9) -> (출력_4=w38, 출력_2=w39, 출력_3=w40, 출력=w41)
          }
        }
        w42 = cluster{"bit stream": i8[][], "Enable?": bool} {all zero or empty}
        w43 = cluster{"t0": f64, "dt": f64, "Y": c128[]} {all zero or empty}
        s2 = uninitialised  # shift register
        s3 = w15  # shift register
        s4 = T6 {all zero or empty}  # shift register
        s5 = w42  # shift register
        s6 = T7 {all zero or empty}  # shift register
        s7 = w43  # shift register
        while (iteration -> i1) {
          call "Packet_Validity.gvi"(QAM Init Parameters=w12, Input Bit Stream=s5, Packet Parameters=w14) -> (Output Bit Stream=w44)
          call "Recover Message.gvi"(Input Stream=s6, Packet Info=s3, Start Loc of Data=w13) -> (Packet Info out=w45)
          Property Node(instance in=w45) -> ("Packet Array"=w46, "Packet Received?"=w47, instance out=w48)
          call "Format_Data.gvi"(Output Packet Array=w46)
          $"OK packet header_3" <- w47
          call "sub_usrp_rx_recept_packet.gvi"(Packet Received?=w47, 루프 반복=i1) -> (PACKET RECEPTION [%]=w49)
          $"[0-3] prob. of reception" <- w49
          call "niUSRP Fetch Rx Data (CDB Cluster).gvi"(session handle=w28, error in=s2, number of samples=w30, timeout=4, channel list="0") -> (session handle out=w50, error out=w51, data=w52, timestamp=w53)
          Is Equal(x=w11, y=i1) -> w54
          And Array Elements(Boolean array=w47) -> (logical AND=w55)
          Logical Or(w55, w51, w54) -> w56
          $"[0-3] END" <- w56
          call "QAM Demodulation.gvi"(Input Packets=s4, Rx dt=w29, QAM Init Parameters=w12) -> (Output Bitstream=w57, recovered complex waveform=w58)
          call "MT Format Constellation.gvi"(waveform=w58, samples per symbol=8, offset=8) -> (constellation graph=w59)
          $"[0-3] constellation" <- w59
          call "sub_usrp_rx_per_link_delay.gvi"(timestamp=w53) -> (fractional seconds=w60)
          $"[0-3] delay" <- w60
          call "Chop_Shell.gvi"(data=s7) -> (SNR=w61, SIGNAL OUT=w62, Output Packets=w63, RSSI=w64)
          Complex To Real And Imaginary(x + iy=w62) -> w65
          $"[0-3] received siganl" <- w65
          $"[0-3] RSSI" <- w64
          call "niUSRP Fetch Rx Data (CDB).gvi"(session handle=w50, error in=w51, timeout=3, channel list="0") -> (data=w66)
          call "check _Power_Spectrum.gvi"(data=w66, PowerSpectrumPSDExport="Power Spectrum"(0)) -> (FFT power spectrum density=w67)
          $"[0-3] spectrum" <- w67
          $"[0-3] SNR" <- w61
          Divide(x=w10, y=100000) -> w68
          call "sub_Ela_time.gvi"(경과 타겟 시간=w68)
          next s2 = w51
          next s3 = w48
          next s4 = w63
          next s5 = w57
          next s6 = w44
          next s7 = w52
          stop if w56
        }
        call "sub_USRP_out.gvi"(입력_2=w50, 입력=s2)
        w69 = cluster{"bit stream": i8[][], "Enable?": bool} {all zero or empty}
        w70 = cluster{"t0": f64, "dt": f64, "Y": c128[]} {all zero or empty}
        s8 = uninitialised  # shift register
        s9 = w19  # shift register
        s10 = T6 {all zero or empty}  # shift register
        s11 = w69  # shift register
        s12 = T7 {all zero or empty}  # shift register
        s13 = w70  # shift register
        while (iteration -> i2) {
          call "Packet_Validity.gvi"(QAM Init Parameters=w16, Input Bit Stream=s11, Packet Parameters=w18) -> (Output Bit Stream=w71)
          call "Recover Message.gvi"(Input Stream=s12, Packet Info=s9, Start Loc of Data=w17) -> (Packet Info out=w72)
          Property Node(instance in=w72) -> ("Packet Array"=w73, "Packet Received?"=w74, instance out=w75)
          call "Format_Data.gvi"(Output Packet Array=w73)
          $"OK packet header_4" <- w74
          call "sub_usrp_rx_recept_packet.gvi"(Packet Received?=w74, 루프 반복=i2) -> (PACKET RECEPTION [%]=w76)
          $"[0-4] prob. of reception" <- w76
          call "niUSRP Fetch Rx Data (CDB Cluster).gvi"(session handle=w31, error in=s8, number of samples=w33, timeout=4, channel list="0") -> (session handle out=w77, error out=w78, data=w79, timestamp=w80)
          Is Equal(x=w11, y=i2) -> w81
          And Array Elements(Boolean array=w74) -> (logical AND=w82)
          Logical Or(w82, w78, w81) -> w83
          $"[0-4] END" <- w83
          call "QAM Demodulation.gvi"(Input Packets=s10, Rx dt=w32, QAM Init Parameters=w16) -> (Output Bitstream=w84, recovered complex waveform=w85)
          call "MT Format Constellation.gvi"(waveform=w85, samples per symbol=8, offset=8) -> (constellation graph=w86)
          $"[0-4] constellation" <- w86
          call "sub_usrp_rx_per_link_delay.gvi"(timestamp=w80) -> (fractional seconds=w87)
          $"[0-4] delay" <- w87
          call "Chop_Shell.gvi"(data=s13) -> (SNR=w88, SIGNAL OUT=w89, Output Packets=w90, RSSI=w91)
          Complex To Real And Imaginary(x + iy=w89) -> w92
          $"[0-4] received siganl" <- w92
          $"[0-4] RSSI" <- w91
          call "niUSRP Fetch Rx Data (CDB).gvi"(session handle=w77, error in=w78, timeout=3, channel list="0") -> (data=w93)
          call "check _Power_Spectrum.gvi"(data=w93, PowerSpectrumPSDExport="Power Spectrum"(0)) -> (FFT power spectrum density=w94)
          $"[0-4] spectrum" <- w94
          $"[0-4] SNR" <- w88
          Divide(x=w10, y=100000) -> w95
          call "sub_Ela_time.gvi"(경과 타겟 시간=w95)
          next s8 = w78
          next s9 = w75
          next s10 = w90
          next s11 = w84
          next s12 = w71
          next s13 = w79
          stop if w83
        }
        call "sub_USRP_out.gvi"(입력_2=w77, 입력=s8)
        w96 = cluster{"bit stream": i8[][], "Enable?": bool} {all zero or empty}
        w97 = cluster{"t0": f64, "dt": f64, "Y": c128[]} {all zero or empty}
        s14 = w37  # shift register
        s15 = w23  # shift register
        s16 = T6 {all zero or empty}  # shift register
        s17 = w96  # shift register
        s18 = T7 {all zero or empty}  # shift register
        s19 = w97  # shift register
        while (iteration -> i3) {
          call "Packet_Validity.gvi"(QAM Init Parameters=w20, Input Bit Stream=s17, Packet Parameters=w22) -> (Output Bit Stream=w98)
          call "Recover Message.gvi"(Input Stream=s18, Packet Info=s15, Start Loc of Data=w21) -> (Packet Info out=w99)
          Property Node(instance in=w99) -> ("Packet Array"=w100, "Packet Received?"=w101, instance out=w102)
          call "Format_Data.gvi"(Output Packet Array=w100)
          $"OK PACKET HEADER" <- w101
          call "sub_usrp_rx_recept_packet.gvi"(Packet Received?=w101, 루프 반복=i3) -> (PACKET RECEPTION [%]=w103)
          $"[0-1] prob. of reception" <- w103
          call "QAM Demodulation.gvi"(Input Packets=s16, Rx dt=w35, QAM Init Parameters=w20) -> (Output Bitstream=w104, recovered complex waveform=w105)
          call "MT Format Constellation.gvi"(waveform=w105, samples per symbol=8, offset=8) -> (constellation graph=w106)
          $"[0-1] constellation" <- w106
          call "niUSRP Fetch Rx Data (CDB Cluster).gvi"(session handle=w34, error in=s14, number of samples=w36, timeout=4, channel list="0") -> (session handle out=w107, error out=w108, data=w109, timestamp=w110)
          call "niUSRP Fetch Rx Data (CDB).gvi"(session handle=w107, error in=w108, timeout=3, channel list="0") -> (data=w111)
          call "check _Power_Spectrum.gvi"(data=w111, PowerSpectrumPSDExport="Power Spectrum"(0)) -> (FFT power spectrum density=w112)
          $"[0-1] spectrum" <- w112
          call "Chop_Shell.gvi"(data=s19) -> (SNR=w113, SIGNAL OUT=w114, Output Packets=w115, RSSI=w116)
          $"[0-1] RSSI" <- w116
          Complex To Real And Imaginary(x + iy=w114) -> w117
          $"[0-1] received siganl" <- w117
          $"[0-1] SNR" <- w113
          Is Equal(x=w11, y=i3) -> w118
          And Array Elements(Boolean array=w101) -> (logical AND=w119)
          Logical Or(w119, w108, w118) -> w120
          $"[0-1] END" <- w120
          call "sub_usrp_rx_per_link_delay.gvi"(timestamp=w110) -> (fractional seconds=w121)
          $"[0-1] delay" <- w121
          Divide(x=w10, y=100000) -> w122
          call "sub_Ela_time.gvi"(경과 타겟 시간=w122)
          next s14 = w108
          next s15 = w102
          next s16 = w115
          next s17 = w104
          next s18 = w98
          next s19 = w109
          stop if w120
        }
        call "sub_USRP_out.gvi"(입력_2=w107, 입력=s14)
        w123 = cluster{"bit stream": i8[][], "Enable?": bool} {all zero or empty}
        w124 = cluster{"t0": f64, "dt": f64, "Y": c128[]} {all zero or empty}
        s20 = w41  # shift register
        s21 = w27  # shift register
        s22 = T6 {all zero or empty}  # shift register
        s23 = w123  # shift register
        s24 = T7 {all zero or empty}  # shift register
        s25 = w124  # shift register
        while (iteration -> i4) {
          call "Packet_Validity.gvi"(QAM Init Parameters=w24, Input Bit Stream=s23, Packet Parameters=w26) -> (Output Bit Stream=w125)
          call "Recover Message.gvi"(Input Stream=s24, Packet Info=s21, Start Loc of Data=w25) -> (Packet Info out=w126)
          Property Node(instance in=w126) -> ("Packet Array"=w127, "Packet Received?"=w128, instance out=w129)
          call "Format_Data.gvi"(Output Packet Array=w127)
          call "sub_usrp_rx_recept_packet.gvi"(Packet Received?=w128, 루프 반복=i4) -> (PACKET RECEPTION [%]=w130)
          $"[0-2] prob. of reception" <- w130
          $"OK packet header_2" <- w128
          call "niUSRP Fetch Rx Data (CDB Cluster).gvi"(session handle=w38, error in=s20, number of samples=w40, timeout=4, channel list="0") -> (session handle out=w131, error out=w132, data=w133, timestamp=w134)
          call "niUSRP Fetch Rx Data (CDB).gvi"(session handle=w131, error in=w132, timeout=3, channel list="0") -> (data=w135)
          call "check _Power_Spectrum.gvi"(data=w135, PowerSpectrumPSDExport="Power Spectrum"(0)) -> (FFT power spectrum density=w136)
          $"[0-2] spectrum" <- w136
          call "QAM Demodulation.gvi"(Input Packets=s22, Rx dt=w39, QAM Init Parameters=w24) -> (Output Bitstream=w137, recovered complex waveform=w138)
          call "MT Format Constellation.gvi"(waveform=w138, samples per symbol=8, offset=8) -> (constellation graph=w139)
          $"[0-2] constellation" <- w139
          call "Chop_Shell.gvi"(data=s25) -> (SNR=w140, SIGNAL OUT=w141, Output Packets=w142, RSSI=w143)
          Complex To Real And Imaginary(x + iy=w141) -> w144
          $"[0-2] received siganl" <- w144
          $"[0-2] RSSI" <- w143
          $"[0-2] SNR" <- w140
          Is Equal(x=w11, y=i4) -> w145
          And Array Elements(Boolean array=w128) -> (logical AND=w146)
          Logical Or(w146, w132, w145) -> w147
          $"[0-2] END" <- w147
          call "sub_usrp_rx_per_link_delay.gvi"(timestamp=w134) -> (fractional seconds=w148)
          $"[0-2] delay" <- w148
          Divide(x=w10, y=100000) -> w149
          call "sub_Ela_time.gvi"(경과 타겟 시간=w149)
          next s20 = w132
          next s21 = w129
          next s22 = w142
          next s23 = w137
          next s24 = w125
          next s25 = w133
          stop if w147
        }
        call "sub_USRP_out.gvi"(입력_2=w131, 입력=s20)
      }
      frame 2 {
        sequence {
          frame 0 {
            Property Node(instance in=$usrp_rx_options) -> ("Modulation Scheme"=w150, "IQ Sampling\nRate [S/sec]"=w151, "Carrier Frequency"=w152, "Gain [dB]"=w153, "Active Antenna"=w154, "Time slot[µs]"=w155, "Max_slot"=w156)
            call "sub_multiple_rx_para.gvi"(Modulation Scheme=w150) -> (출력_7=w157, 출력_4=w158, 출력_2=w159, 출력_3=w160)
            call "sub_multiple_rx_para.gvi"(Modulation Scheme=w150) -> (출력_7=w161, 출력_4=w162, 출력_2=w163, 출력_3=w164)
            call "sub_multiple_rx_para.gvi"(Modulation Scheme=w150) -> (출력_7=w165, 출력_4=w166, 출력_2=w167, 출력_3=w168)
            call "sub_multi_rx's_para.gvi"(원소="192.168.10.6", IQ Sampling Rate [S/sec]=w151, Carrier Frequency=w152, Gain [dB]=w153, Active Antenna=w154) -> (출력_4=w169, 출력_2=w170, 출력_3=w171)
            call "sub_multi_rx's_para.gvi"(원소="192.168.10.4", IQ Sampling Rate [S/sec]=w151, Carrier Frequency=w152, Gain [dB]=w153, Active Antenna=w154) -> (출력_4=w172, 출력_2=w173, 출력_3=w174, 출력=w175)
            call "sub_multi_rx's_para.gvi"(원소="192.168.10.5", IQ Sampling Rate [S/sec]=w151, Carrier Frequency=w152, Gain [dB]=w153, Active Antenna=w154) -> (출력_4=w176, 출력_2=w177, 출력_3=w178, 출력=w179)
          }
        }
        w180 = cluster{"bit stream": i8[][], "Enable?": bool} {all zero or empty}
        w181 = cluster{"t0": f64, "dt": f64, "Y": c128[]} {all zero or empty}
        s26 = uninitialised  # shift register
        s27 = w160  # shift register
        s28 = T6 {all zero or empty}  # shift register
        s29 = w180  # shift register
        s30 = T7 {all zero or empty}  # shift register
        s31 = w181  # shift register
        while (iteration -> i5) {
          call "Packet_Validity.gvi"(QAM Init Parameters=w157, Input Bit Stream=s29, Packet Parameters=w159) -> (Output Bit Stream=w182)
          call "Recover Message.gvi"(Input Stream=s30, Packet Info=s27, Start Loc of Data=w158) -> (Packet Info out=w183)
          Property Node(instance in=w183) -> ("Packet Array"=w184, "Packet Received?"=w185, instance out=w186)
          call "Format_Data.gvi"(Output Packet Array=w184)
          $"OK packet header_7" <- w185
          call "sub_usrp_rx_recept_packet.gvi"(Packet Received?=w185, 루프 반복=i5) -> (PACKET RECEPTION [%]=w187)
          $"[1-4] prob. of reception" <- w187
          call "niUSRP Fetch Rx Data (CDB Cluster).gvi"(session handle=w169, error in=s26, number of samples=w171, timeout=4, channel list="0") -> (session handle out=w188, error out=w189, data=w190, timestamp=w191)
          Is Equal(x=w156, y=i5) -> w192
          And Array Elements(Boolean array=w185) -> (logical AND=w193)
          Logical Or(w193, w189, w192) -> w194
          $"[1-4] END" <- w194
          call "QAM Demodulation.gvi"(Input Packets=s28, Rx dt=w170, QAM Init Parameters=w157) -> (Output Bitstream=w195, recovered complex waveform=w196)
          call "MT Format Constellation.gvi"(waveform=w196, samples per symbol=8, offset=8) -> (constellation graph=w197)
          $"[1-4] constellation" <- w197
          call "sub_usrp_rx_per_link_delay.gvi"(timestamp=w191) -> (fractional seconds=w198)
          $"[1-4] delay" <- w198
          call "Chop_Shell.gvi"(data=s31) -> (SNR=w199, SIGNAL OUT=w200, Output Packets=w201, RSSI=w202)
          Complex To Real And Imaginary(x + iy=w200) -> w203
          $"[1-4] received siganl" <- w203
          $"[1-4] RSSI" <- w202
          call "niUSRP Fetch Rx Data (CDB).gvi"(session handle=w188, error in=w189, timeout=3, channel list="0") -> (data=w204)
          call "check _Power_Spectrum.gvi"(data=w204, PowerSpectrumPSDExport="Power Spectrum"(0)) -> (FFT power spectrum density=w205)
          $"[1-4] spectrum" <- w205
          $"[1-4] SNR" <- w199
          Divide(x=w155, y=100000) -> w206
          call "sub_Ela_time.gvi"(경과 타겟 시간=w206)
          next s26 = w189
          next s27 = w186
          next s28 = w201
          next s29 = w195
          next s30 = w182
          next s31 = w190
          stop if w194
        }
        call "sub_USRP_out.gvi"(입력_2=w188, 입력=s26)
        w207 = cluster{"bit stream": i8[][], "Enable?": bool} {all zero or empty}
        w208 = cluster{"t0": f64, "dt": f64, "Y": c128[]} {all zero or empty}
        s32 = w175  # shift register
        s33 = w164  # shift register
        s34 = T6 {all zero or empty}  # shift register
        s35 = w207  # shift register
        s36 = T7 {all zero or empty}  # shift register
        s37 = w208  # shift register
        while (iteration -> i6) {
          call "Packet_Validity.gvi"(QAM Init Parameters=w161, Input Bit Stream=s35, Packet Parameters=w163) -> (Output Bit Stream=w209)
          call "Recover Message.gvi"(Input Stream=s36, Packet Info=s33, Start Loc of Data=w162) -> (Packet Info out=w210)
          Property Node(instance in=w210) -> ("Packet Array"=w211, "Packet Received?"=w212, instance out=w213)
          call "Format_Data.gvi"(Output Packet Array=w211)
          $"OK PACKET HEADER_5" <- w212
          call "sub_usrp_rx_recept_packet.gvi"(Packet Received?=w212, 루프 반복=i6) -> (PACKET RECEPTION [%]=w214)
          $"[1-2] prob. of reception" <- w214
          call "niUSRP Fetch Rx Data (CDB Cluster).gvi"(session handle=w172, error in=s32, number of samples=w174, timeout=4, channel list="0") -> (session handle out=w215, error out=w216, data=w217, timestamp=w218)
          Is Equal(x=w156, y=i6) -> w219
          And Array Elements(Boolean array=w212) -> (logical AND=w220)
          Logical Or(w220, w216, w219) -> w221
          $"[1-2] END" <- w221
          call "QAM Demodulation.gvi"(Input Packets=s34, Rx dt=w173, QAM Init Parameters=w161) -> (Output Bitstream=w222, recovered complex waveform=w223)
          call "MT Format Constellation.gvi"(waveform=w223, samples per symbol=8, offset=8) -> (constellation graph=w224)
          $"[1-2] constellation" <- w224
          call "sub_usrp_rx_per_link_delay.gvi"(timestamp=w218) -> (fractional seconds=w225)
          $"[1-2] delay" <- w225
          call "Chop_Shell.gvi"(data=s37) -> (SNR=w226, SIGNAL OUT=w227, Output Packets=w228, RSSI=w229)
          Complex To Real And Imaginary(x + iy=w227) -> w230
          $"[1-2] received siganl" <- w230
          $"[1-2] RSSI" <- w229
          $"[1-2] SNR" <- w226
          call "niUSRP Fetch Rx Data (CDB).gvi"(session handle=w215, error in=w216, timeout=3, channel list="0") -> (data=w231)
          call "check _Power_Spectrum.gvi"(data=w231, PowerSpectrumPSDExport="Power Spectrum"(0)) -> (FFT power spectrum density=w232)
          $"[1-2] spectrum" <- w232
          Divide(x=w155, y=100000) -> w233
          call "sub_Ela_time.gvi"(경과 타겟 시간=w233)
          next s32 = w216
          next s33 = w213
          next s34 = w228
          next s35 = w222
          next s36 = w209
          next s37 = w217
          stop if w221
        }
        call "sub_USRP_out.gvi"(입력_2=w215, 입력=s32)
        w234 = cluster{"bit stream": i8[][], "Enable?": bool} {all zero or empty}
        w235 = cluster{"t0": f64, "dt": f64, "Y": c128[]} {all zero or empty}
        s38 = w179  # shift register
        s39 = w168  # shift register
        s40 = T6 {all zero or empty}  # shift register
        s41 = w234  # shift register
        s42 = T7 {all zero or empty}  # shift register
        s43 = w235  # shift register
        while (iteration -> i7) {
          call "Packet_Validity.gvi"(QAM Init Parameters=w165, Input Bit Stream=s41, Packet Parameters=w167) -> (Output Bit Stream=w236)
          call "Recover Message.gvi"(Input Stream=s42, Packet Info=s39, Start Loc of Data=w166) -> (Packet Info out=w237)
          Property Node(instance in=w237) -> ("Packet Array"=w238, "Packet Received?"=w239, instance out=w240)
          call "Format_Data.gvi"(Output Packet Array=w238)
          call "sub_usrp_rx_recept_packet.gvi"(Packet Received?=w239, 루프 반복=i7) -> (PACKET RECEPTION [%]=w241)
          $"[1-3] prob. of reception" <- w241
          $"OK packet header_6" <- w239
          call "niUSRP Fetch Rx Data (CDB Cluster).gvi"(session handle=w176, error in=s38, number of samples=w178, timeout=4, channel list="0") -> (session handle out=w242, error out=w243, data=w244, timestamp=w245)
          Is Equal(x=w156, y=i7) -> w246
          And Array Elements(Boolean array=w239) -> (logical AND=w247)
          Logical Or(w247, w243, w246) -> w248
          $"[1-3] END" <- w248
          call "QAM Demodulation.gvi"(Input Packets=s40, Rx dt=w177, QAM Init Parameters=w165) -> (Output Bitstream=w249, recovered complex waveform=w250)
          call "MT Format Constellation.gvi"(waveform=w250, samples per symbol=8, offset=8) -> (constellation graph=w251)
          $"[1-3] constellation" <- w251
          call "sub_usrp_rx_per_link_delay.gvi"(timestamp=w245) -> (fractional seconds=w252)
          $"[1-3] delay" <- w252
          call "Chop_Shell.gvi"(data=s43) -> (SNR=w253, SIGNAL OUT=w254, Output Packets=w255, RSSI=w256)
          Complex To Real And Imaginary(x + iy=w254) -> w257
          $"[1-3] received siganl" <- w257
          $"[1-3] RSSI" <- w256
          $"[1-3] SNR" <- w253
          call "niUSRP Fetch Rx Data (CDB).gvi"(session handle=w242, error in=w243, timeout=3, channel list="0") -> (data=w258)
          call "check _Power_Spectrum.gvi"(data=w258, PowerSpectrumPSDExport="Power Spectrum"(0)) -> (FFT power spectrum density=w259)
          $"[1-3] spectrum" <- w259
          Divide(x=w155, y=100000) -> w260
          call "sub_Ela_time.gvi"(경과 타겟 시간=w260)
          next s38 = w243
          next s39 = w240
          next s40 = w255
          next s41 = w249
          next s42 = w236
          next s43 = w244
          stop if w248
        }
        call "sub_USRP_out.gvi"(입력_2=w242, 입력=s38)
      }
      frame 3 {
        sequence {
          frame 0 {
            Property Node(instance in=$usrp_rx_options) -> ("Modulation Scheme"=w261, "IQ Sampling\nRate [S/sec]"=w262, "Carrier Frequency"=w263, "Gain [dB]"=w264, "Active Antenna"=w265, "Time slot[µs]"=w266, "Max_slot"=w267)
            call "sub_multiple_rx_para.gvi"(Modulation Scheme=w261) -> (출력_7=w268, 출력_4=w269, 출력_2=w270, 출력_3=w271)
            call "sub_multiple_rx_para.gvi"(Modulation Scheme=w261) -> (출력_7=w272, 출력_4=w273, 출력_2=w274, 출력_3=w275)
            call "sub_multi_rx's_para.gvi"(원소="192.168.10.5", IQ Sampling Rate [S/sec]=w262, Carrier Frequency=w263, Gain [dB]=w264, Active Antenna=w265) -> (출력_4=w276, 출력_2=w277, 출력_3=w278, 출력=w279)
            call "sub_multi_rx's_para.gvi"(원소="192.168.10.6", IQ Sampling Rate [S/sec]=w262, Carrier Frequency=w263, Gain [dB]=w264, Active Antenna=w265) -> (출력_4=w280, 출력_2=w281, 출력_3=w282, 출력=w283)
          }
        }
        w284 = cluster{"bit stream": i8[][], "Enable?": bool} {all zero or empty}
        w285 = cluster{"t0": f64, "dt": f64, "Y": c128[]} {all zero or empty}
        s44 = w279  # shift register
        s45 = w271  # shift register
        s46 = T6 {all zero or empty}  # shift register
        s47 = w284  # shift register
        s48 = T7 {all zero or empty}  # shift register
        s49 = w285  # shift register
        while (iteration -> i8) {
          call "Packet_Validity.gvi"(QAM Init Parameters=w268, Input Bit Stream=s47, Packet Parameters=w270) -> (Output Bit Stream=w286)
          call "Recover Message.gvi"(Input Stream=s48, Packet Info=s45, Start Loc of Data=w269) -> (Packet Info out=w287)
          Property Node(instance in=w287) -> ("Packet Array"=w288, "Packet Received?"=w289, instance out=w290)
          call "Format_Data.gvi"(Output Packet Array=w288)
          $"OK PACKET HEADER_8" <- w289
          call "sub_usrp_rx_recept_packet.gvi"(Packet Received?=w289, 루프 반복=i8) -> (PACKET RECEPTION [%]=w291)
          $"[2-3] prob. of reception" <- w291
          call "niUSRP Fetch Rx Data (CDB Cluster).gvi"(session handle=w276, error in=s44, number of samples=w278, timeout=4, channel list="0") -> (session handle out=w292, error out=w293, data=w294, timestamp=w295)
          Is Equal(x=w267, y=i8) -> w296
          And Array Elements(Boolean array=w289) -> (logical AND=w297)
          Logical Or(w297, w293, w296) -> w298
          $"[2-3] END" <- w298
          call "QAM Demodulation.gvi"(Input Packets=s46, Rx dt=w277, QAM Init Parameters=w268) -> (Output Bitstream=w299, recovered complex waveform=w300)
          call "MT Format Constellation.gvi"(waveform=w300, samples per symbol=8, offset=8) -> (constellation graph=w301)
          $"[2-3] constellation" <- w301
          call "sub_usrp_rx_per_link_delay.gvi"(timestamp=w295) -> (fractional seconds=w302)
          $"[2-3] delay" <- w302
          call "Chop_Shell.gvi"(data=s49) -> (SNR=w303, SIGNAL OUT=w304, Output Packets=w305, RSSI=w306)
          $"[2-3] RSSI" <- w306
          Complex To Real And Imaginary(x + iy=w304) -> w307
          $"[2-3] received siganl" <- w307
          $"[2-3] SNR" <- w303
          call "niUSRP Fetch Rx Data (CDB).gvi"(session handle=w292, error in=w293, timeout=3, channel list="0") -> (data=w308)
          call "check _Power_Spectrum.gvi"(data=w308, PowerSpectrumPSDExport="Power Spectrum"(0)) -> (FFT power spectrum density=w309)
          $"[2-3] spectrum" <- w309
          Divide(x=w266, y=100000) -> w310
          call "sub_Ela_time.gvi"(경과 타겟 시간=w310)
          next s44 = w293
          next s45 = w290
          next s46 = w305
          next s47 = w299
          next s48 = w286
          next s49 = w294
          stop if w298
        }
        call "sub_USRP_out.gvi"(입력_2=w292, 입력=s44)
        w311 = cluster{"bit stream": i8[][], "Enable?": bool} {all zero or empty}
        w312 = cluster{"t0": f64, "dt": f64, "Y": c128[]} {all zero or empty}
        s50 = w283  # shift register
        s51 = w275  # shift register
        s52 = T6 {all zero or empty}  # shift register
        s53 = w311  # shift register
        s54 = T7 {all zero or empty}  # shift register
        s55 = w312  # shift register
        while (iteration -> i9) {
          call "Packet_Validity.gvi"(QAM Init Parameters=w272, Input Bit Stream=s53, Packet Parameters=w274) -> (Output Bit Stream=w313)
          call "Recover Message.gvi"(Input Stream=s54, Packet Info=s51, Start Loc of Data=w273) -> (Packet Info out=w314)
          Property Node(instance in=w314) -> ("Packet Array"=w315, "Packet Received?"=w316, instance out=w317)
          call "Format_Data.gvi"(Output Packet Array=w315)
          call "sub_usrp_rx_recept_packet.gvi"(Packet Received?=w316, 루프 반복=i9) -> (PACKET RECEPTION [%]=w318)
          $"[2-4] prob. of reception" <- w318
          $"OK packet header_9" <- w316
          call "niUSRP Fetch Rx Data (CDB Cluster).gvi"(session handle=w280, error in=s50, number of samples=w282, timeout=4, channel list="0") -> (session handle out=w319, error out=w320, data=w321, timestamp=w322)
          Is Equal(x=w267, y=i9) -> w323
          And Array Elements(Boolean array=w316) -> (logical AND=w324)
          Logical Or(w324, w320, w323) -> w325
          $"[2-4] END" <- w325
          call "QAM Demodulation.gvi"(Input Packets=s52, Rx dt=w281, QAM Init Parameters=w272) -> (Output Bitstream=w326, recovered complex waveform=w327)
          call "MT Format Constellation.gvi"(waveform=w327, samples per symbol=8, offset=8) -> (constellation graph=w328)
          $"[2-4] constellation" <- w328
          call "sub_usrp_rx_per_link_delay.gvi"(timestamp=w322) -> (fractional seconds=w329)
          $"[2-4] delay" <- w329
          call "Chop_Shell.gvi"(data=s55) -> (SNR=w330, SIGNAL OUT=w331, Output Packets=w332, RSSI=w333)
          Complex To Real And Imaginary(x + iy=w331) -> w334
          $"[2-4] received siganl" <- w334
          $"[2-4] RSSI" <- w333
          $"[2-4] SNR" <- w330
          call "niUSRP Fetch Rx Data (CDB).gvi"(session handle=w319, error in=w320, timeout=3, channel list="0") -> (data=w335)
          call "check _Power_Spectrum.gvi"(data=w335, PowerSpectrumPSDExport="Power Spectrum"(0)) -> (FFT power spectrum density=w336)
          $"[2-4] spectrum" <- w336
          Divide(x=w266, y=100000) -> w337
          call "sub_Ela_time.gvi"(경과 타겟 시간=w337)
          next s50 = w320
          next s51 = w317
          next s52 = w332
          next s53 = w326
          next s54 = w313
          next s55 = w321
          stop if w325
        }
        call "sub_USRP_out.gvi"(입력_2=w319, 입력=s50)
      }
      frame 4 {
        sequence {
          frame 0 {
            Property Node(instance in=$usrp_rx_options) -> ("Modulation Scheme"=w338, "IQ Sampling\nRate [S/sec]"=w339, "Carrier Frequency"=w340, "Gain [dB]"=w341, "Active Antenna"=w342, "Time slot[µs]"=w343, "Max_slot"=w344)
            call "sub_multiple_rx_para.gvi"(Modulation Scheme=w338) -> (출력_7=w345, 출력_4=w346, 출력_2=w347, 출력_3=w348)
            call "sub_multi_rx's_para.gvi"(원소="192.168.10.6", IQ Sampling Rate [S/sec]=w339, Carrier Frequency=w340, Gain [dB]=w341, Active Antenna=w342) -> (출력_4=w349, 출력_2=w350, 출력_3=w351, 출력=w352)
          }
        }
        w353 = cluster{"bit stream": i8[][], "Enable?": bool} {all zero or empty}
        w354 = cluster{"t0": f64, "dt": f64, "Y": c128[]} {all zero or empty}
        s56 = w352  # shift register
        s57 = w348  # shift register
        s58 = T6 {all zero or empty}  # shift register
        s59 = w353  # shift register
        s60 = T7 {all zero or empty}  # shift register
        s61 = w354  # shift register
        while (iteration -> i10) {
          call "Packet_Validity.gvi"(QAM Init Parameters=w345, Input Bit Stream=s59, Packet Parameters=w347) -> (Output Bit Stream=w355)
          call "Recover Message.gvi"(Input Stream=s60, Packet Info=s57, Start Loc of Data=w346) -> (Packet Info out=w356)
          Property Node(instance in=w356) -> ("Packet Array"=w357, "Packet Received?"=w358, instance out=w359)
          call "Format_Data.gvi"(Output Packet Array=w357)
          $"OK PACKET HEADER_10" <- w358
          call "sub_usrp_rx_recept_packet.gvi"(Packet Received?=w358, 루프 반복=i10) -> (PACKET RECEPTION [%]=w360)
          $"[3-4] prob. of reception" <- w360
          call "niUSRP Fetch Rx Data (CDB Cluster).gvi"(session handle=w349, error in=s56, number of samples=w351, timeout=4, channel list="0") -> (session handle out=w361, error out=w362, data=w363, timestamp=w364)
          Is Equal(x=w344, y=i10) -> w365
          And Array Elements(Boolean array=w358) -> (logical AND=w366)
          Logical Or(w366, w362, w365) -> w367
          $"[3-4] END" <- w367
          call "QAM Demodulation.gvi"(Input Packets=s58, Rx dt=w350, QAM Init Parameters=w345) -> (Output Bitstream=w368, recovered complex waveform=w369)
          call "MT Format Constellation.gvi"(waveform=w369, samples per symbol=8, offset=8) -> (constellation graph=w370)
          $"[3-4] constellation" <- w370
          call "sub_usrp_rx_per_link_delay.gvi"(timestamp=w364) -> (fractional seconds=w371)
          $"[3-4] delay" <- w371
          call "Chop_Shell.gvi"(data=s61) -> (SNR=w372, SIGNAL OUT=w373, Output Packets=w374, RSSI=w375)
          Complex To Real And Imaginary(x + iy=w373) -> w376
          $"[3-4] received siganl" <- w376
          $"[3-4] RSSI" <- w375
          $"[3-4] SNR" <- w372
          call "niUSRP Fetch Rx Data (CDB).gvi"(session handle=w361, error in=w362, timeout=3, channel list="0") -> (data=w377)
          call "check _Power_Spectrum.gvi"(data=w377, PowerSpectrumPSDExport="Power Spectrum"(0)) -> (FFT power spectrum density=w378)
          $"[3-4] spectrum" <- w378
          Divide(x=w343, y=100000) -> w379
          call "sub_Ela_time.gvi"(경과 타겟 시간=w379)
          next s56 = w362
          next s57 = w359
          next s58 = w374
          next s59 = w368
          next s60 = w355
          next s61 = w363
          stop if w367
        }
        call "sub_USRP_out.gvi"(입력_2=w361, 입력=s56)
      }
    }
    case (s1) {
      frame 0, Default {
        Property Node(instance in=$usrp_tx_options) -> ("padding samples"=w380, "Modulation Scheme"=w381, "IQ Sampling\nRate [S/sec]"=w382, "Carrier Frequency"=w383, "Gain [dB]"=w384, "Active Antenna"=w385, "Exit time"=w386)
        call "sub_tx_m-qam_para.gvi"(Modulation Scheme_2=w381) -> (Packet Parameters=w387, QAM system parameters=w388, bit per symbol=w389)
        call "Create Packet.gvi"(Packet Parameters=w387, QAM system parameters=w388, Pulse Shaping Filter Parameters=T9 {"Alpha"=0.5, "Filter Length"=6, "TX Filter"="none"}, Packet Pad [samples]=w380) -> (Packets=w390, Number of Packets=w391)
        w392 = cluster{"t0": f64, "dt": f64, "Y": c128[]} {all zero or empty}
        Obtain Queue(element data type=w392, max queue size=20) -> (error out=w393, queue out=w394)
        while (iteration -> i11) {
          call "sub_usrp_tx_master.gvi"(입력_4=w394, 입력_2=w390, 루프 반복=i11, 입력_3=w391, 입력=w393) -> (출력_3=w395, 출력_2=w396, 선택자=w397, 출력=w398)
          case (w397) {
            frame False, Default {
              w399 = w398
            }
            frame True {
              call "sub_usrp_tx_constellation.gvi"(입력=w396, 입력_2=w389) -> (Source I/Q Constellation=w400)
              $"[0-n] S. constellation" <- w400
              Enqueue Element(element=w396, error in=w398, queue=w395) -> (error out=w399)
            }
          }
          stop if w399
        }
        call "sub_USRP_tx_set.gvi"(Device IP=w4, IQ Sampling Rate [S/sec]=w382, Carrier Frequency=w383, Gain [dB]=w384, Active Antenna=w385) -> (출력_3=w401, 출력=w402, 출력_2=w403)
        Get Current Time() -> (current time=w404)
        while (iteration -> i12) {
          call "check_ready_time.gvi"(입력_2=w404, 입력=w386) -> (입력 3=w405)
          call "sub_usrp_tx_slave.gvi"(입력_2=w394, 입력=w393) -> (출력=w406, 선택자=w407, 출력_2=w408)
          case (w407) {
            frame False, Default {
              Dequeue Element(error in=w408, queue=w406) -> (element=w409, error out=w411, queue out=w410)
            }
            frame True {
              w409 = w401
              w410 = w406
              w411 = w408
            }
          }
          Logical And($"[0-1] END", $"[0-2] END", $"[0-3] END", $"[0-4] END") -> w412
          call "niUSRP Write Tx Data (CDB Cluster).gvi"(session handle=w402, error in=w403, data=w409, timeout=5, end of data?=$stop, channel list="0") -> (session handle out=w413, error out=w414)
          call "sub_error_remover.gvi"([exception code]=-1074118645, Error In=w414) -> (Error Out=w415)
          Logical Or(w411, w415, $stop, w405, w412) -> w416
          call "sub_usrp_tx_ready.gvi"(루프 반복=i12, stop=$stop) -> (Ready=w417)
          $"[0] ready" <- w417
          stop if w416
        }
        call "sub_usrp_tx_esc.gvi"(입력_3=w410, 입력_2=w411, 입력=w413, 입력_4=w415)
      }
      frame 1 {
        Property Node(instance in=$usrp_tx_options) -> ("padding samples"=w418, "Modulation Scheme"=w419, "IQ Sampling\nRate [S/sec]"=w420, "Carrier Frequency"=w421, "Gain [dB]"=w422, "Active Antenna"=w423, "Exit time"=w424)
        call "sub_tx_m-qam_para.gvi"(Modulation Scheme_2=w419) -> (Packet Parameters=w425, QAM system parameters=w426, bit per symbol=w427)
        call "sub_USRP_tx_set.gvi"(Device IP=w4, IQ Sampling Rate [S/sec]=w420, Carrier Frequency=w421, Gain [dB]=w422, Active Antenna=w423) -> (출력_3=w428, 출력=w429, 출력_2=w430, T2=w431)
        call "Create Packet.gvi"(Packet Parameters=w425, Tx IQ Sampling Rate [s/sec]=w431, QAM system parameters=w426, Pulse Shaping Filter Parameters=T9 {"Alpha"=0.5, "Filter Length"=6, "TX Filter"="none"}, Packet Pad [samples]=w418) -> (Packets=w432, Number of Packets=w433)
        w434 = cluster{"t0": f64, "dt": f64, "Y": c128[]} {all zero or empty}
        Obtain Queue(element data type=w434, max queue size=20) -> (error out=w435, queue out=w436)
        while (iteration -> i13) {
          call "sub_usrp_tx_master.gvi"(입력_4=w436, 입력_2=w432, 루프 반복=i13, 입력_3=w433, 입력=w435) -> (출력_3=w437, 출력_2=w438, 선택자=w439, 출력=w440)
          case (w439) {
            frame False, Default {
              w441 = w440
            }
            frame True {
              call "sub_usrp_tx_constellation.gvi"(입력=w438, 입력_2=w427) -> (Source I/Q Constellation=w442)
              $"[1-n] S. constellation" <- w442
              Enqueue Element(element=w438, error in=w440, queue=w437) -> (error out=w441)
            }
          }
          stop if w441
        }
        Get Current Time() -> (current time=w443)
        while (iteration -> i14) {
          call "check_ready_time.gvi"(입력_2=w443, 입력=w424) -> (입력 3=w444)
          call "sub_usrp_tx_slave.gvi"(입력_2=w436, 입력=w435) -> (출력=w445, 선택자=w446, 출력_2=w447)
          case (w446) {
            frame False, Default {
              Dequeue Element(error in=w447, queue=w445) -> (element=w448, error out=w450, queue out=w449)
            }
            frame True {
              w448 = w428
              w449 = w445
              w450 = w447
            }
          }
          Logical And($"[1-2] END", $"[1-3] END", $"[1-4] END") -> w451
          call "niUSRP Write Tx Data (CDB Cluster).gvi"(session handle=w429, error in=w430, data=w448, timeout=5, end of data?=FALSE, channel list="0") -> (session handle out=w452, error out=w453)
          call "sub_error_remover.gvi"([exception code]=-1074118645, Error In=w453) -> (Error Out=w454)
          Logical Or(w450, w454, FALSE, w444, w451) -> w455
          call "sub_usrp_tx_ready.gvi"(루프 반복=i14, stop=FALSE) -> (Ready=w456)
          $"[1] ready" <- w456
          stop if w455
        }
        call "sub_usrp_tx_esc.gvi"(입력_3=w449, 입력_2=w450, 입력=w452, 입력_4=w454)
      }
      frame 2 {
        Property Node(instance in=$usrp_tx_options) -> ("padding samples"=w457, "Modulation Scheme"=w458, "IQ Sampling\nRate [S/sec]"=w459, "Carrier Frequency"=w460, "Gain [dB]"=w461, "Active Antenna"=w462, "Exit time"=w463)
        call "sub_tx_m-qam_para.gvi"(Modulation Scheme_2=w458) -> (Packet Parameters=w464, QAM system parameters=w465, bit per symbol=w466)
        call "sub_USRP_tx_set.gvi"(Device IP=w4, IQ Sampling Rate [S/sec]=w459, Carrier Frequency=w460, Gain [dB]=w461, Active Antenna=w462) -> (출력_3=w467, 출력=w468, 출력_2=w469, T2=w470)
        call "Create Packet.gvi"(Packet Parameters=w464, Tx IQ Sampling Rate [s/sec]=w470, QAM system parameters=w465, Pulse Shaping Filter Parameters=T9 {"Alpha"=0.5, "Filter Length"=6, "TX Filter"="none"}, Packet Pad [samples]=w457) -> (Packets=w471, Number of Packets=w472)
        w473 = cluster{"t0": f64, "dt": f64, "Y": c128[]} {all zero or empty}
        Obtain Queue(element data type=w473, max queue size=20) -> (error out=w474, queue out=w475)
        while (iteration -> i15) {
          call "sub_usrp_tx_master.gvi"(입력_4=w475, 입력_2=w471, 루프 반복=i15, 입력_3=w472, 입력=w474) -> (출력_3=w476, 출력_2=w477, 선택자=w478, 출력=w479)
          case (w478) {
            frame False, Default {
              w480 = w479
            }
            frame True {
              call "sub_usrp_tx_constellation.gvi"(입력=w477, 입력_2=w466) -> (Source I/Q Constellation=w481)
              $"[2-n] S. constellation" <- w481
              Enqueue Element(element=w477, error in=w479, queue=w476) -> (error out=w480)
            }
          }
          stop if w480
        }
        Get Current Time() -> (current time=w482)
        while (iteration -> i16) {
          call "check_ready_time.gvi"(입력_2=w482, 입력=w463) -> (입력 3=w483)
          call "sub_usrp_tx_slave.gvi"(입력_2=w475, 입력=w474) -> (출력=w484, 선택자=w485, 출력_2=w486)
          case (w485) {
            frame False, Default {
              Dequeue Element(error in=w486, queue=w484) -> (element=w487, error out=w489, queue out=w488)
            }
            frame True {
              w487 = w467
              w488 = w484
              w489 = w486
            }
          }
          call "niUSRP Write Tx Data (CDB Cluster).gvi"(session handle=w468, error in=w469, data=w487, timeout=5, end of data?=FALSE, channel list="0") -> (session handle out=w490, error out=w491)
          call "sub_error_remover.gvi"([exception code]=-1074118645, Error In=w491) -> (Error Out=w492)
          Logical And($"[2-3] END", $"[2-4] END") -> w493
          Logical Or(w489, w492, FALSE, w483, w493) -> w494
          call "sub_usrp_tx_ready.gvi"(루프 반복=i16, stop=FALSE) -> (Ready=w495)
          $"[2] ready" <- w495
          stop if w494
        }
        call "sub_usrp_tx_esc.gvi"(입력_3=w488, 입력_2=w489, 입력=w490, 입력_4=w492)
      }
      frame 3 {
        Property Node(instance in=$usrp_tx_options) -> ("padding samples"=w496, "Modulation Scheme"=w497, "IQ Sampling\nRate [S/sec]"=w498, "Carrier Frequency"=w499, "Gain [dB]"=w500, "Active Antenna"=w501, "Exit time"=w502)
        call "sub_tx_m-qam_para.gvi"(Modulation Scheme_2=w497) -> (Packet Parameters=w503, QAM system parameters=w504, bit per symbol=w505)
        call "sub_USRP_tx_set.gvi"(Device IP=w4, IQ Sampling Rate [S/sec]=w498, Carrier Frequency=w499, Gain [dB]=w500, Active Antenna=w501) -> (출력_3=w506, 출력=w507, 출력_2=w508, T2=w509)
        call "Create Packet.gvi"(Packet Parameters=w503, Tx IQ Sampling Rate [s/sec]=w509, QAM system parameters=w504, Pulse Shaping Filter Parameters=T9 {"Alpha"=0.5, "Filter Length"=6, "TX Filter"="none"}, Packet Pad [samples]=w496) -> (Packets=w510, Number of Packets=w511)
        w512 = cluster{"t0": f64, "dt": f64, "Y": c128[]} {all zero or empty}
        Obtain Queue(element data type=w512, max queue size=20) -> (error out=w513, queue out=w514)
        while (iteration -> i17) {
          call "sub_usrp_tx_master.gvi"(입력_4=w514, 입력_2=w510, 루프 반복=i17, 입력_3=w511, 입력=w513) -> (출력_3=w515, 출력_2=w516, 선택자=w517, 출력=w518)
          case (w517) {
            frame False, Default {
              w519 = w518
            }
            frame True {
              call "sub_usrp_tx_constellation.gvi"(입력=w516, 입력_2=w505) -> (Source I/Q Constellation=w520)
              $"[3-n] S. constellation" <- w520
              Enqueue Element(element=w516, error in=w518, queue=w515) -> (error out=w519)
            }
          }
          stop if w519
        }
        Get Current Time() -> (current time=w521)
        while (iteration -> i18) {
          call "check_ready_time.gvi"(입력_2=w521, 입력=w502) -> (입력 3=w522)
          call "sub_usrp_tx_slave.gvi"(입력_2=w514, 입력=w513) -> (출력=w523, 선택자=w524, 출력_2=w525)
          case (w524) {
            frame False, Default {
              Dequeue Element(error in=w525, queue=w523) -> (element=w526, error out=w528, queue out=w527)
            }
            frame True {
              w526 = w506
              w527 = w523
              w528 = w525
            }
          }
          call "niUSRP Write Tx Data (CDB Cluster).gvi"(session handle=w507, error in=w508, data=w526, timeout=5, end of data?=FALSE, channel list="0") -> (session handle out=w529, error out=w530)
          call "sub_error_remover.gvi"([exception code]=-1074118645, Error In=w530) -> (Error Out=w531)
          Logical Or(w528, w531, FALSE, w522, $"[3-4] END") -> w532
          call "sub_usrp_tx_ready.gvi"(루프 반복=i18, stop=FALSE) -> (Ready=w533)
          $"[3] ready" <- w533
          stop if w532
        }
        call "sub_usrp_tx_esc.gvi"(입력_3=w527, 입력_2=w528, 입력=w529, 입력_4=w531)
      }
    }
    next s1 = w3
    stop if w2
  }
  while {
    Logical And($"[0] ready", $"[1] ready", $"[2] ready", $"[3-4] END") -> w534
    $"Performance?" <- w534
    call "sub_multiple_usrp_rx_performance.gvi"([0-1] RSSI=$"[0-1] SNR", [0-2] RSSI=$"[0-2] SNR", [0-3] RSSI=$"[0-3] SNR", [0-4] RSSI=$"[0-4] SNR", [1-2] RSSI=$"[1-2] SNR", [1-3] RSSI=$"[1-3] SNR", [1-4] RSSI=$"[1-4] SNR", [2-3] RSSI=$"[2-3] SNR", [2-4] RSSI=$"[2-4] SNR", [3-4] RSSI=$"[3-4] SNR") -> (RSSI [-dBm]=w535)
    $"SNR [dB]" <- w535
    call "sub_multiple_usrp_rx_performance.gvi"([0-1] RSSI=$"[0-1] delay", [0-2] RSSI=$"[0-2] delay", [0-3] RSSI=$"[0-3] delay", [0-4] RSSI=$"[0-4] delay", [1-2] RSSI=$"[1-2] delay", [1-3] RSSI=$"[1-3] delay", [1-4] RSSI=$"[1-4] delay", [2-3] RSSI=$"[2-3] delay", [2-4] RSSI=$"[2-4] delay", [3-4] RSSI=$"[3-4] delay") -> (RSSI [-dBm]=w536)
    $"Per link delay" <- w536
    call "sub_multiple_usrp_rx_performance.gvi"([0-1] RSSI=$"[0-1] prob. of reception", [0-2] RSSI=$"[0-2] prob. of reception", [0-3] RSSI=$"[0-3] prob. of reception", [0-4] RSSI=$"[0-4] prob. of reception", [1-2] RSSI=$"[1-2] prob. of reception", [1-3] RSSI=$"[1-3] prob. of reception", [1-4] RSSI=$"[1-4] prob. of reception", [2-3] RSSI=$"[2-3] prob. of reception", [2-4] RSSI=$"[2-4] prob. of reception", [3-4] RSSI=$"[3-4] prob. of reception") -> (RSSI [-dBm]=w537)
    $"Prob. packet reception [%]" <- w537
    call "sub_multiple_usrp_rx_performance.gvi"([0-1] RSSI=$"[0-1] RSSI", [0-2] RSSI=$"[0-2] RSSI", [0-3] RSSI=$"[0-3] RSSI", [0-4] RSSI=$"[0-4] RSSI", [1-2] RSSI=$"[1-2] RSSI", [1-3] RSSI=$"[1-3] RSSI", [1-4] RSSI=$"[1-4] RSSI", [2-3] RSSI=$"[2-3] RSSI", [2-4] RSSI=$"[2-4] RSSI", [3-4] RSSI=$"[3-4] RSSI") -> (RSSI [-dBm]=w538)
    $"RSSI [-dBm]" <- w538
    case ($Priority) {
      frame 0, Default {
        call "sub_2D_performance_convert_to_1D(dicision_path).gvi"(Priority=$Priority, Input_2D_array=$"SNR [dB]") -> ([0-N] optimal-path=w539, [1-N] optimal-path=w540, [2-N] optimal-path=w541, [3-N] optimal-path=w542)
      }
      frame 1 {
        call "sub_2D_performance_convert_to_1D(dicision_path).gvi"(Priority=$Priority, Input_2D_array=$"RSSI [-dBm]") -> ([0-N] optimal-path=w539, [1-N] optimal-path=w540, [2-N] optimal-path=w541, [3-N] optimal-path=w542)
      }
      frame 2 {
        call "sub_2D_performance_convert_to_1D(dicision_path).gvi"(Priority=$Priority, Input_2D_array=$"Prob. packet reception [%]") -> ([0-N] optimal-path=w539, [1-N] optimal-path=w540, [2-N] optimal-path=w541, [3-N] optimal-path=w542)
      }
    }
    $"[0 to n] optimal path" <- w539
    $"[1 to n] optimal path" <- w540
    case ($"Routing scheme") {
      frame 0, Default {
        call "sub_optimal_usrp_link_array.gvi"(Routing scheme=$"Routing scheme", [0 to n] optimal path=w539, [1 to n] optimal path=w540, [2 to n] optimal path=w541, [3 to n] optimal path=w542) -> (String Array w/o Duplicates=w543, table=w544)
      }
      frame 1 {
        call "sub_optimal_usrp_link_array.gvi"(Routing scheme=$"Routing scheme", [0 to n] optimal path=w539, [1 to n] optimal path=w540, [2 to n] optimal path=w541, [3 to n] optimal path=w542) -> (String Array w/o Duplicates=w543, table=w544)
      }
      frame 2 {
        call "sub_optimal_usrp_link_array.gvi"(Routing scheme=$"Routing scheme", [0 to n] optimal path=w539, [1 to n] optimal path=w540, [2 to n] optimal path=w541, [3 to n] optimal path=w542) -> (String Array w/o Duplicates=w543, table=w544)
      }
    }
    $"Array w/o Duplicates" <- w543
    $"generated table" <- w544
    $"[2 to n] optimal path" <- w541
    $"[3 to n] optimal path" <- w542
    stop if w534
  }
  case (w534) {
    frame False, Default { }
    frame True {
      Property Node(instance in=$usrp_tx_options) -> ("padding samples"=w545, "Modulation Scheme"=w546, "IQ Sampling\nRate [S/sec]"=w547, "Carrier Frequency"=w548, "Gain [dB]"=w549, "Active Antenna"=w550, "Exit time"=w551)
      call "sub_tx_m-qam_para.gvi"(Modulation Scheme_2=w546) -> (Packet Parameters=w552, QAM system parameters=w553, bit per symbol=w554)
      call "sub_USRP_tx_set.gvi"(Device IP="192.168.10.4", IQ Sampling Rate [S/sec]=w547, Carrier Frequency=w548, Gain [dB]=w549, Active Antenna=w550) -> (출력_3=w555, 출력=w556, 출력_2=w557, T2=w558)
      call "Create Packet.gvi"(Packet Parameters=w552, Tx IQ Sampling Rate [s/sec]=w558, QAM system parameters=w553, Pulse Shaping Filter Parameters=T9 {"Alpha"=0.5, "Filter Length"=6, "TX Filter"="none"}, Packet Pad [samples]=w545) -> (Packets=w559, Number of Packets=w560)
      w561 = cluster{"t0": f64, "dt": f64, "Y": c128[]} {all zero or empty}
      Obtain Queue(element data type=w561, max queue size=20) -> (error out=w562, queue out=w563)
      while (iteration -> i19) {
        call "sub_usrp_tx_master.gvi"(입력_4=w563, 입력_2=w559, 루프 반복=i19, 입력_3=w560, 입력=w562) -> (출력_3=w564, 출력_2=w565, 선택자=w566, 출력=w567)
        case (w566) {
          frame False, Default {
            w568 = w567
          }
          frame True {
            call "sub_usrp_tx_constellation.gvi"(입력=w565, 입력_2=w554) -> (Source I/Q Constellation=w569)
            $"[0-n] S. constellation_2" <- w569
            Enqueue Element(element=w565, error in=w567, queue=w564) -> (error out=w568)
          }
        }
        stop if w568
      }
      Get Current Time() -> (current time=w570)
      while (iteration -> i20) {
        call "check_ready_time.gvi"(입력_2=w570, 입력=w551) -> (입력 3=w571)
        call "sub_usrp_tx_slave.gvi"(입력_2=w563, 입력=w562) -> (출력=w572, 선택자=w573, 출력_2=w574)
        case (w573) {
          frame False, Default {
            Dequeue Element(error in=w574, queue=w572) -> (element=w575, error out=w577, queue out=w576)
          }
          frame True {
            w575 = w555
            w576 = w572
            w577 = w574
          }
        }
        call "niUSRP Write Tx Data (CDB Cluster).gvi"(session handle=w556, error in=w557, data=w575, timeout=5, end of data?=$stop_2, channel list="0") -> (session handle out=w578, error out=w579)
        call "sub_error_remover.gvi"([exception code]=-1074118645, Error In=w579) -> (Error Out=w580)
        Logical Or(w577, w580, $stop_2, w571, $"[D] END") -> w581
        call "sub_usrp_tx_ready.gvi"(루프 반복=i20, stop=$stop_2) -> (Ready=w582)
        $"[D] ready" <- w582
        stop if w581
      }
      call "sub_usrp_tx_esc.gvi"(입력_3=w576, 입력_2=w577, 입력=w578, 입력_4=w580)
      Property Node(instance in=$usrp_rx_options) -> ("Modulation Scheme"=w583, "IQ Sampling\nRate [S/sec]"=w584, "Carrier Frequency"=w585, "Gain [dB]"=w586, "Active Antenna"=w587, "Time slot[µs]"=w588, "Max_slot"=w589)
      call "sub_multiple_rx_para.gvi"(Modulation Scheme=w583) -> (출력_7=w590, 출력_4=w591, 출력_2=w592, 출력_3=w593)
      call "sub_multi_rx's_para.gvi"(원소="192.168.10.6", IQ Sampling Rate [S/sec]=w584, Carrier Frequency=w585, Gain [dB]=w586, Active Antenna=w587) -> (출력_4=w594, 출력_2=w595, 출력_3=w596, 출력=w597)
      w598 = cluster{"bit stream": i8[][], "Enable?": bool} {all zero or empty}
      w599 = cluster{"t0": f64, "dt": f64, "Y": c128[]} {all zero or empty}
      s62 = w597  # shift register
      s63 = w593  # shift register
      s64 = T6 {all zero or empty}  # shift register
      s65 = w598  # shift register
      s66 = T7 {all zero or empty}  # shift register
      s67 = w599  # shift register
      while (iteration -> i21) {
        call "Packet_Validity.gvi"(QAM Init Parameters=w590, Input Bit Stream=s65, Packet Parameters=w592) -> (Output Bit Stream=w600)
        call "Recover Message.gvi"(Input Stream=s66, Packet Info=s63, Start Loc of Data=w591) -> (Packet Info out=w601)
        Property Node(instance in=w601) -> ("Packet Array"=w602, "Packet Received?"=w603, instance out=w604)
        $Destination <- w603
        call "sub_usrp_rx_recept_packet.gvi"(Packet Received?=w603, 루프 반복=i21) -> (PACKET RECEPTION [%]=w605)
        $"[D] prob. of packet reception (%)" <- w605
        call "Format_Data.gvi"(Output Packet Array=w602) -> (Received Message=w606)
        $"[D] Received Message" <- w606
        call "QAM Demodulation.gvi"(Input Packets=s64, Rx dt=w595, QAM Init Parameters=w590) -> (Output Bitstream=w607, recovered complex waveform=w608)
        call "MT Format Constellation.gvi"(waveform=w608, samples per symbol=8, offset=8) -> (constellation graph=w609)
        $"[D] constellation" <- w609
        call "niUSRP Fetch Rx Data (CDB Cluster).gvi"(session handle=w594, error in=s62, number of samples=w596, timeout=4, channel list="0") -> (session handle out=w610, error out=w611, data=w612, timestamp=w613)
        call "niUSRP Fetch Rx Data (CDB).gvi"(session handle=w610, error in=w611, timeout=3, channel list="0") -> (data=w614)
        call "check _Power_Spectrum.gvi"(data=w614, PowerSpectrumPSDExport="Power Spectrum"(0)) -> (FFT power spectrum density=w615)
        $"[D] Power spectrum" <- w615
        call "Chop_Shell.gvi"(data=s67) -> (SNR=w616, SIGNAL OUT=w617, Output Packets=w618, RSSI=w619)
        Complex To Real And Imaginary(x + iy=w617) -> w620
        $"[D] received signal" <- w620
        $"[D] RSSI" <- w619
        $"[D] SNR" <- w616
        Is Equal(x=w589, y=i21) -> w621
        And Array Elements(Boolean array=w603) -> (logical AND=w622)
        Logical Or(w622, w611, w621) -> w623
        $"[D] END" <- w623
        call "sub_usrp_rx_per_link_delay.gvi"(timestamp=w613) -> (fractional seconds=w624)
        $"[D] delay" <- w624
        Divide(x=w588, y=100000) -> w625
        call "sub_Ela_time.gvi"(경과 타겟 시간=w625)
        next s62 = w611
        next s63 = w604
        next s64 = w618
        next s65 = w607
        next s66 = w600
        next s67 = w612
        stop if w623
      }
      call "sub_USRP_out.gvi"(입력_2=w610, 입력=s62)
    }
  }
